# Grasshopper definition 0.0_MISC_SD_RENDER_001.gh (Grasshopper 1.0.8)
# plug-ins: RhinoCodePluginGH

# MACHINE LEARNING IN GRASSHOPPER
# from DATAFRAMES to DATATREES
www_wickersonstudios_com = Script()  # -> out, A
# ---------- www_wickersonstudios_com: Python ----------
#! python3
#r: openpyxl, psycopg2, IPython

import rhinoscriptsyntax as rs
import scriptcontext as sc

import System
import System.Collections.Generic
import Rhino

import sys
import pandas as pd
import matplotlib
import numpy as np
import scipy as sp
import IPython
import sklearn
from Grasshopper import DataTree
from Grasshopper.Kernel.Data import GH_Path

# Function to add text to a DataTree
def add_to_datatree(path, text, tree):
    tree.Add(text, path)

# Create a DataTree to store version information
version_info = DataTree[object]()

# Adding version information to the DataTree
add_to_datatree(GH_Path(0), "Python version: {}".format(sys.version), version_info)
add_to_datatree(GH_Path(1), "pandas version: {}".format(pd.__version__), version_info)
add_to_datatree(GH_Path(2), "matplotlib version: {}".format(matplotlib.__version__), version_info)
add_to_datatree(GH_Path(3), "NumPy version: {}".format(np.__version__), version_info)
add_to_datatree(GH_Path(4), "SciPy version: {}".format(sp.__version__), version_info)
add_to_datatree(GH_Path(5), "IPython version: {}".format(IPython.__version__), version_info)
add_to_datatree(GH_Path(6), "scikit-learn version: {}".format(sklearn.__version__), version_info)

# Output the DataTree
A = version_info
# ---------- end www_wickersonstudios_com ----------
# import sys
# print(sys.path)
# 
# You will find where python is installed.
# They actually get a separated python 3.9 for
# Rhino8 for you (from what I see).
# 
# Then go to the directory of that python3.9,
# inside folder \Scripts you will find pip.
# Then go to cmd, cd to the directory of the
# \Scripts folder (The Rhino8 one).
# Then you can pip install whatever you want.
# I got matplotlib successfully installed in my case.
# 
# ADDITIONAL REQUIREMENTS:
# 
# #! python3
# #r: openpyxl, psycopg2
panel = Panel(www_wickersonstudios_com.A)
# Created at
# Wickerson Studios
# copyright 2024
# download all materials at
# www.wickersonstudios.com
# MACHINE LEARNING
# MISC pt-cloud render
# upload all files at
# www.wickersonstudios.com
misc_sd_render_001 = Script()  # -> out, A
# ---------- misc_sd_render_001: Python ----------
#! python3
#r: openpyxl, psycopg2, IPython

import rhinoscriptsyntax as rs
import scriptcontext as sc
import System
import Rhino
import sys
import numpy as np
import matplotlib.pyplot as plt
from matplotlib import image as mpimg
from Grasshopper import DataTree
from Grasshopper.Kernel.Data import GH_Path

# Function to load and prepare an image (placeholder for your actual image processing)
def process_image(path):
    # Load an image file (this should be replaced with the actual image processing logic)
    img = mpimg.imread(path)
    # For the sake of example, let's just convert it to grayscale (not actual stable diffusion)
    gray = np.dot(img[..., :3], [0.2989, 0.5870, 0.1140])
    return gray

# Function to add numpy array to a DataTree
def numpy_array_to_datatree(array, tree, base_path):
    for i, row in enumerate(array):
        path = GH_Path(base_path, i)
        for value in row:
            tree.Add(value, path)

# Create a DataTree to store image data
image_data_tree = DataTree[object]()

# Example hardcoded image path (you need to have this image accessible in your environment)
image_path = "C:\\Users\\Sculpture\\Desktop\\Capture.jpg"  # Corrected path with proper escape for backslashes.

# Process the image
processed_image = process_image(image_path)

# Convert processed image data to DataTree
numpy_array_to_datatree(processed_image, image_data_tree, 0)

# Output the DataTree
A = image_data_tree
# ---------- end misc_sd_render_001 ----------

# ----
# data visualization
panel_2 = Panel("{0;0}")
tree_branch = TreeBranch(Tree=misc_sd_render_001.A, Path=panel_2, MaintainPaths=True)
tree_statistics = TreeStatistics(Tree=misc_sd_render_001.A)  # -> Paths, Length, Count
list_length = ListLength(List=tree_branch)
list_length_2 = ListLength(List=tree_statistics.Paths)
square = Square(Plane=PlaneXY(0, 0, 0), Size=1, ExtentX=list_length_2, ExtentY=list_length)  # -> Cells, Points
deconstruct = Deconstruct(Point=square.Points)  # -> XComponent, YComponent, ZComponent
pi = Pi(Factor=Slider(0.5, range=0..1))
construct_point = ConstructPoint(XCoordinate=deconstruct.XComponent, YCoordinate=deconstruct.YComponent, ZCoordinate=misc_sd_render_001.A)
negative = Negative(Value=pi)
rotate = Rotate(Geometry=construct_point, Angle=negative, Plane=PlaneXY(0, 0, 0))  # -> Geometry, Transform

# ----
# Machine Learning Algorithm
# (***with ghpythonlib.treehelpers
# for DataTrees in gh***)
# Introduction
# Application: IRIS
param_viewer = ParamViewer(misc_sd_render_001.A)
panel_3 = Panel(misc_sd_render_001.A)
