# Grasshopper definition 1.2_ML_intro_numpy.gh (Grasshopper 1.0.8)
# plug-ins: RhinoCodePluginGH

_1_2_ml_intro_numpy_df_gh = Script()  # -> out, A
# ---------- _1_2_ml_intro_numpy_df_gh: Python ----------
import numpy as np
import ghpythonlib.treehelpers as th

# Create a 2D array similar to the NumPy array
x = np.array([[1, 2, 3], [4, 5, 6]])

# Print the array
print("x:\n{}".format(x))

# Convert the array to a nested list for output in Grasshopper
x_nested = x.tolist()

# Output the array as a nested list
A = th.list_to_tree(x_nested)
# ---------- end _1_2_ml_intro_numpy_df_gh ----------
_1_2_ml_intro_numpy = Script()  # -> out, A
# ---------- _1_2_ml_intro_numpy: Python ----------
# requirements: numpy

import numpy as np

# Create a 2D array similar to the NumPy array
x = np.array([[1, 2, 3], [4, 5, 6]])

# Print the array
print("x:\n{}".format(x))

# Output the array
A = x
# ---------- end _1_2_ml_intro_numpy ----------
param_viewer = ParamViewer(_1_2_ml_intro_numpy.out)
panel = Panel(_1_2_ml_intro_numpy.A)
param_viewer_2 = ParamViewer(_1_2_ml_intro_numpy_df_gh.out)
panel_2 = Panel(_1_2_ml_intro_numpy_df_gh.A)
# Created at
# Wickerson Studios
# copyright 2024
# download all materials at
# www.wickersonstudios.com
# Machine Learning Algorithm
# (***with ghpythonlib.treehelpers
# for DataTrees in gh***)
# Introduction
# NUMPY
number_slider = Slider(3, range=0..10)
_1_2_ml_intro_numpy_df_gh_2 = Script(rowIn=number_slider, colsIn=Slider(3, range=0..10), start=Slider(1.79, range=0..10), step=Slider(0.66, range=0..10))  # -> out, A; inputs rowIn: Int32, colsIn: Int32, start: Double, step: Double
# ---------- _1_2_ml_intro_numpy_df_gh_2: Python ----------
import numpy as np
import ghpythonlib.treehelpers as th

# Define input parameters
rows = rowIn
cols = colsIn
start_value = start
step_value = step

# Generate a 2D array based on input parameters
x = np.array([[start_value + i + j for i in range(cols)] for j in range(rows)])

# Print the array
print("x:\n{}".format(x))

# Convert the array to a nested list for output in Grasshopper
x_nested = x.tolist()

# Output the array as a nested list
A = th.list_to_tree(x_nested)
# ---------- end _1_2_ml_intro_numpy_df_gh_2 ----------
# import sys
# print(sys.path)
# 
# You will find where python is installed.
# They actually get a separated python 3.9 for
# Rhino8 for you (from what I see).
# 
# Then go to the directory of that python3.9,
# inside folder \Scripts you will find pip.
# Then go to cmd, cd to the directory of the
# \Scripts folder (The Rhino8 one).
# Then you can pip install whatever you want.
# I got matplotlib successfully installed in my case.
panel_3 = Panel(_1_2_ml_intro_numpy_df_gh_2.out)
panel_4 = Panel(_1_2_ml_intro_numpy_df_gh_2.A)
