# Grasshopper definition 1.3_ML_intro_SciPy_002.gh (Grasshopper 1.0.8)
# plug-ins: RhinoCodePluginGH

_1_2_ml_intro_numpy_df_gh = Script()  # -> out, A
# ---------- _1_2_ml_intro_numpy_df_gh: Python ----------
import numpy as np
import ghpythonlib.treehelpers as th

# Create a 2D array similar to the NumPy array
x = np.array([[1, 2, 3], [4, 5, 6]])

# Print the array
print("x:\n{}".format(x))

# Convert the array to a nested list for output in Grasshopper
x_nested = x.tolist()

# Output the array as a nested list
A = th.list_to_tree(x_nested)
# ---------- end _1_2_ml_intro_numpy_df_gh ----------
_1_2_ml_intro_numpy = Script()  # -> out, A
# ---------- _1_2_ml_intro_numpy: Python ----------
# requirements: numpy

import numpy as np

# Create a 2D array similar to the NumPy array
x = np.array([[1, 2, 3], [4, 5, 6]])

# Print the array
print("x:\n{}".format(x))

# Output the array
A = x
# ---------- end _1_2_ml_intro_numpy ----------
# Created at
# Wickerson Studios
# copyright 2024
# download all materials at
# www.wickersonstudios.com
param_viewer = ParamViewer(_1_2_ml_intro_numpy.out)
panel = Panel(_1_2_ml_intro_numpy.A)
param_viewer_2 = ParamViewer(_1_2_ml_intro_numpy_df_gh.out)
panel_2 = Panel(_1_2_ml_intro_numpy_df_gh.A)
# Machine Learning Algorithm
# (***with ghpythonlib.treehelpers
# for DataTrees in gh***)
# Introduction
# SciPy
number_slider = Slider(3, range=0..10)
_13_ml_intro_scipy_df_gh_001 = Script(sizeIn=number_slider)  # -> out, A; inputs sizeIn: Int32
# ---------- _13_ml_intro_scipy_df_gh_001: Python ----------
import numpy as np
from scipy import sparse
import ghpythonlib.treehelpers as th

# Define input parameters
size = sizeIn

# Create a 2D NumPy array with a diagonal of ones and zeros everywhere else
eye = np.eye(size)

# Convert the NumPy array to a sparse matrix
sparse_eye = sparse.csr_matrix(eye)

# Print the sparse matrix
print("Sparse matrix:\n{}".format(sparse_eye))

# Convert the sparse matrix to a nested list for output in Grasshopper
sparse_eye_nested = sparse_eye.toarray().tolist()

# Output the sparse matrix as a nested list
A = th.list_to_tree(sparse_eye_nested)
# ---------- end _13_ml_intro_scipy_df_gh_001 ----------
_13_ml_intro_scipy_df_gh_002 = Script(sizeIn=Slider(3, range=0..10))  # -> out, A, B; inputs sizeIn: Int32
# ---------- _13_ml_intro_scipy_df_gh_002: Python ----------
import numpy as np
from scipy import sparse
import ghpythonlib.treehelpers as th

# Define input parameters
size = sizeIn

# Create a 2D NumPy array with a diagonal of ones and zeros everywhere else
eye = np.eye(size)

# Convert the NumPy array to a sparse matrix
sparse_eye = sparse.csr_matrix(eye)

# Print the sparse matrix
print("Sparse matrix:\n{}".format(sparse_eye))

# Convert the NumPy array to a SciPy sparse matrix in CSR format
# Only the nonzero entries are stored
sparse_matrix = sparse.csr_matrix(eye)
print("\nSciPy sparse CSR matrix:\n{}".format(sparse_matrix))

# Convert the sparse matrix to a nested list for output in Grasshopper
sparse_eye_nested = sparse_eye.toarray().tolist()

# Output the sparse matrix as a nested list
A = th.list_to_tree(sparse_eye_nested)

# Extract non-zero entries (row indices, column indices, and values)
rows, cols = sparse_eye.nonzero()
values = sparse_eye.data

# Combine rows, columns, and values into a list of tuples
non_zero_entries = list(zip(rows, cols, values))

# Output non-zero entries as a nested list
B = th.list_to_tree(non_zero_entries)
# ---------- end _13_ml_intro_scipy_df_gh_002 ----------
# import sys
# print(sys.path)
# 
# You will find where python is installed.
# They actually get a separated python 3.9 for
# Rhino8 for you (from what I see).
# 
# Then go to the directory of that python3.9,
# inside folder \Scripts you will find pip.
# Then go to cmd, cd to the directory of the
# \Scripts folder (The Rhino8 one).
# Then you can pip install whatever you want.
# I got matplotlib successfully installed in my case.
panel_3 = Panel(_13_ml_intro_scipy_df_gh_001.out)
panel_4 = Panel(_13_ml_intro_scipy_df_gh_001.A)
panel_5 = Panel(_13_ml_intro_scipy_df_gh_002.B)
panel_6 = Panel(_13_ml_intro_scipy_df_gh_002.out)
panel_7 = Panel(_13_ml_intro_scipy_df_gh_002.A)
