# Grasshopper definition 1.4_ML_intro_matplotlib_001b.gh (Grasshopper 1.0.8)
# plug-ins: RhinoCodePluginGH

# Created at
# Wickerson Studios
# copyright 2024
# download all materials at
# www.wickersonstudios.com
# Machine Learning Algorithm
# (***with ghpythonlib.treehelpers
# for DataTrees in gh***)
# Introduction
# alternative  for matplotlib
_1_4_ml_intro_matplotlib_001 = Script(thresholdIn=Slider(0.7, range=0..1))  # -> out, A, B; inputs thresholdIn: Double
# ---------- _1_4_ml_intro_matplotlib_001: Python ----------
# requirements: packaging
# requirements: Pillow
# requirements: pyparsing

import numpy as np
import packaging
#import matplotlib.pyplot as plt
from scipy import sparse
import ghpythonlib.treehelpers as th

# Generate a sequence of numbers from -10 to 10 with 100 steps in between
x = np.linspace(-10, 10, 100)
# Create a second array using sine
y = np.sin(x)

# Plot the sine wave
'''
plt.figure(figsize=(10, 5))
plt.plot(x, y, marker="x")
plt.title("Sine Wave")
plt.xlabel("X values")
plt.ylabel("Sine of X")
plt.grid(True)
plt.show()
'''

# Convert the sine values into a sparse matrix, where we only store values above a certain threshold (e.g., 0.5)
threshold = thresholdIn
data = np.where(np.abs(y) > threshold, y, 0)
sparse_matrix = sparse.csr_matrix(data)

# Output the full matrix as a nested list (though only non-zero values are stored efficiently)
full_matrix_nested = sparse_matrix.toarray().tolist()
A = th.list_to_tree(full_matrix_nested)

# Extract non-zero entries (indices and values)
rows, _ = sparse_matrix.nonzero()  # only one dimension in data
values = sparse_matrix.data

# Combine indices and values into a list of tuples
non_zero_entries = list(zip(rows, values))

# Output non-zero entries as a nested list
B = th.list_to_tree(non_zero_entries)

# Printing for demonstration (replace with output in your actual environment)
print("Full Matrix (Nested List for Grasshopper):\n", A)
print("Non-Zero Entries:\n", B)
# ---------- end _1_4_ml_intro_matplotlib_001 ----------
panel = Panel(_1_4_ml_intro_matplotlib_001.A)
panel_2 = Panel(_1_4_ml_intro_matplotlib_001.out)
panel_3 = Panel(_1_4_ml_intro_matplotlib_001.B)
list_length = ListLength(List=panel)
construct_domain = ConstructDomain(DomainStart=Slider(0, range=0..100), DomainEnd=Slider(12.8, range=0..100))
range = Range(Domain=construct_domain, Steps=expr("x-1", list_length))
construct_point = ConstructPoint(XCoordinate=range, YCoordinate=flatten(panel), ZCoordinate=0)
construct_point_2 = ConstructPoint(XCoordinate=range, YCoordinate=flatten(panel_3), ZCoordinate=0)
construct_point_3 = ConstructPoint(XCoordinate=range, YCoordinate=panel_3, ZCoordinate=0)
interpolate = Interpolate(Vertices=construct_point, Degree=3, Periodic=False, KnotStyle=1)  # -> Curve, Length, Domain
interpolate_2 = Interpolate(Vertices=construct_point_3, Degree=3, Periodic=False, KnotStyle=1)  # -> Curve, Length, Domain
interpolate_3 = Interpolate(Vertices=construct_point_2, Degree=3, Periodic=False, KnotStyle=1)  # -> Curve, Length, Domain
unit_z = UnitZ(Factor=Slider(2.99, range=0..10))
move = Move(Geometry=interpolate_3.Curve, Motion=unit_z)  # -> Geometry, Transform
loft = Loft(
    Curves=[interpolate.Curve, move.Geometry],
    Options={Adjust=False, Closed=False, LoftEnds=0, LoftSimp=0, LoftType=0, Rebuild=10, Refit=0.01})
