# Grasshopper definition 1.5_ML_intro_alt_pandas_001b.gh (Grasshopper 1.0.8)
# plug-ins: RhinoCodePluginGH

_1_5_ml_intro_alt_pandas_001 = Script()  # -> out, A
# ---------- _1_5_ml_intro_alt_pandas_001: Python ----------
from Grasshopper import DataTree
from Grasshopper.Kernel.Data import GH_Path

# Create a simple dataset of people using a list of dictionaries
people = [
    {'Name': "John", 'Location': "New York", 'Age': 24},
    {'Name': "Anna", 'Location': "Paris", 'Age': 13},
    {'Name': "Peter", 'Location': "Berlin", 'Age': 53},
    {'Name': "Linda", 'Location': "London", 'Age': 33}
]

# Function to convert list of dictionaries to DataTree
def list_dict_to_datatree(list_dict):
    """ Convert a list of dictionaries to a Grasshopper DataTree """
    dt = DataTree[object]()
    for index, item in enumerate(list_dict):
        for key, value in item.items():
            # Create a path based on the index of the dictionary in the list
            path = GH_Path(index)
            # Add each key-value pair in the dictionary to the tree
            dt.Add(str(key) + ": " + str(value), path)
    return dt

# Convert the list of dictionaries to a DataTree
tree = list_dict_to_datatree(people)

# Output the DataTree
A = tree
# ---------- end _1_5_ml_intro_alt_pandas_001 ----------
panel = Panel(_1_5_ml_intro_alt_pandas_001.A)
panel_2 = Panel(_1_5_ml_intro_alt_pandas_001.out)
# Machine Learning Algorithm
# (***with ghpythonlib.treehelpers
# for DataTrees in gh***)
# Introduction
# pandas
panel_3 = Panel("""John, New York, 24
Anna, Paris, 13
Peter, Berlin, 53
Linda, London, 33""")
# Created at
# Wickerson Studios
# copyright 2024
# download all materials at
# www.wickersonstudios.com
_1_5_ml_intro_alt_pandas_001b = Script(x=panel_3)  # -> out, A; inputs x: list of String
# ---------- _1_5_ml_intro_alt_pandas_001b: Python ----------
from Grasshopper import DataTree
from Grasshopper.Kernel.Data import GH_Path

# Define the function to convert list of dictionaries to DataTree
def list_dict_to_datatree(list_dict):
    """ Convert a list of dictionaries to a Grasshopper DataTree """
    dt = DataTree[object]()
    for index, item in enumerate(list_dict):
        for key, value in item.items():
            # Create a path based on the index of the dictionary in the list
            path = GH_Path(index)
            # Add each key-value pair in the dictionary to the tree
            dt.Add(str(key) + ": " + str(value), path)
    return dt

# Assume 'people_input' is passed as an input from a Grasshopper component and may be a DataTree
people_input = x  # 'x' should be connected to a Grasshopper input

# Function to iterate over DataTree and retrieve data as list of strings
def extract_data_from_datatree(data_tree):
    data_list = []
    for path, items in data_tree.Paths:
        for item in data_tree.Branch(path):
            data_list.append(item)
    return data_list

# Check if people_input is a DataTree and extract data accordingly
if isinstance(people_input, DataTree):
    people_input = extract_data_from_datatree(people_input)

# Ensure there is data before processing
if people_input is None or not people_input:
    print("No input provided or input is empty. Please connect an input with people data.")
else:
    # Convert input strings to list of dictionaries if input is not None
    people = []
    for person in people_input:
        try:
            name, location, age = person.split(", ")
            people.append({'Name': name, 'Location': location, 'Age': int(age)})
        except ValueError:
            print("Error processing input:", person, "Expected format: 'Name, Location, Age'")

    # Convert the list of dictionaries to a DataTree
    tree = list_dict_to_datatree(people)

    # Output the DataTree
    A = tree
# ---------- end _1_5_ml_intro_alt_pandas_001b ----------
panel_4 = Panel(_1_5_ml_intro_alt_pandas_001b.A)
panel_5 = Panel(_1_5_ml_intro_alt_pandas_001b.out)
