# Grasshopper definition 1.5_ML_intro_pandasFIX_001.gh (Grasshopper 1.0.8)
# plug-ins: RhinoCodePluginGH

script = Script()  # -> out, a
# ---------- script: Python ----------
import rhinoscriptsyntax as rs
import scriptcontext as sc
import math

import System
import System.Collections.Generic
import Rhino

import locale
locale.setlocale(locale.LC_ALL, 'en_US.UTF-8')

import rhinoscriptsyntax as rs
import json
import pandas as pd
 
#prompt the user for a file to import
filter = "JSON file (*.json)|*.json|All Files (*.*)|*.*||"
filename = rs.OpenFileName("Open JSON File", filter)
 
#Read JSON data into the datastore variable
# ---------- end script ----------
script_2 = Script()  # -> out, A
# ---------- script_2: Python ----------
#! python3
#r: openpyxl, psycopg2


import rhinoscriptsyntax as rs
import scriptcontext as sc

import System
import System.Collections.Generic
import Rhino

import locale
locale.setlocale(locale.LC_ALL, 'en_US')
import openpyxl
import psycopg2

import pandas as pd
print(pd.__version__)

import ghpythonlib.treehelpers as th

# Create a simple dataset of people
data = {
    'Name': ["John", "Anna", "Peter", "Linda"],
    'Location' : ["New York", "Paris", "Berlin", "London"],
    'Age' : [24, 13, 53, 33]
}

# Convert the dictionary to a pandas DataFrame
data_pandas = pd.DataFrame(data)

# Convert DataFrame to list of lists (nested list) for each row
data_list = data_pandas.values.tolist()

# Convert nested list to data tree
data_tree = th.list_to_tree(data_list)

# Output data_tree will now contain the DataFrame data in a format usable in Grasshopper
A = data_tree
# ---------- end script_2 ----------
# import sys
# print(sys.path)
# 
# You will find where python is installed.
# They actually get a separated python 3.9 for
# Rhino8 for you (from what I see).
# 
# Then go to the directory of that python3.9,
# inside folder \Scripts you will find pip.
# Then go to cmd, cd to the directory of the
# \Scripts folder (The Rhino8 one).
# Then you can pip install whatever you want.
# I got matplotlib successfully installed in my case.
# 
# ADDITIONAL REQUIREMENTS:
# 
# #! python3
# #r: openpyxl, psycopg2
panel = Panel(script_2.A)
