# Grasshopper definition 1.5_ML_intro_pandas_001.gh (Grasshopper 1.0.8)
# plug-ins: RhinoCodePluginGH

# Created at
# Wickerson Studios
# copyright 2024
# download all materials at
# www.wickersonstudios.com
# Machine Learning Algorithm
# (***with ghpythonlib.treehelpers
# for DataTrees in gh***)
# Introduction
# pandas
number_slider = Slider(0.7, range=0..1)
_1_5_ml_intro_pandas_001 = Script()  # -> out, A
# ---------- _1_5_ml_intro_pandas_001: Python ----------
#! python3
#r: openpyxl, psycopg2


import rhinoscriptsyntax as rs
import scriptcontext as sc

import System
import System.Collections.Generic
import Rhino

import locale
locale.setlocale(locale.LC_ALL, 'en_US')
import openpyxl
import psycopg2

import pandas as pd
print(pd.__version__)

import ghpythonlib.treehelpers as th

# Create a simple dataset of people
data = {
    'Name': ["John", "Anna", "Peter", "Linda"],
    'Location' : ["New York", "Paris", "Berlin", "London"],
    'Age' : [24, 13, 53, 33]
}

# Convert the dictionary to a pandas DataFrame
data_pandas = pd.DataFrame(data)

# Convert DataFrame to list of lists (nested list) for each row
data_list = data_pandas.values.tolist()

# Convert nested list to data tree
data_tree = th.list_to_tree(data_list)

# Output data_tree will now contain the DataFrame data in a format usable in Grasshopper
A = data_tree
# ---------- end _1_5_ml_intro_pandas_001 ----------
panel = Panel(_1_5_ml_intro_pandas_001.A)
# import sys
# print(sys.path)
# 
# You will find where python is installed.
# They actually get a separated python 3.9 for
# Rhino8 for you (from what I see).
# 
# Then go to the directory of that python3.9,
# inside folder \Scripts you will find pip.
# Then go to cmd, cd to the directory of the
# \Scripts folder (The Rhino8 one).
# Then you can pip install whatever you want.
# I got matplotlib successfully installed in my case.
# 
# ADDITIONAL REQUIREMENTS:
# 
# #! python3
# #r: openpyxl, psycopg2
panel_2 = Panel(_1_5_ml_intro_pandas_001.out)
