# Grasshopper definition 1.6_ML_intro_mglearn_001.gh (Grasshopper 1.0.8)
# plug-ins: RhinoCodePluginGH

# Machine Leanring in Python 3.0 NEW
# Script Editor in Rhino8 at
# Wickerson Studios
# 
# upload everything to date at:
# www.wickersonstudios.com
_1_6_ml_intro_mglearn_001c = Script()  # -> out, A
# ---------- _1_6_ml_intro_mglearn_001c: Python ----------
#! python3


import rhinoscriptsyntax as rs
import scriptcontext as sc

import System
import System.Collections.Generic
import Rhino

import locale
locale.setlocale(locale.LC_ALL, 'en_US')
import openpyxl
import psycopg2 

#import pandas as pd
#print(pd.__version__)

import sys
import pandas as pd
import matplotlib
import numpy as np
import scipy as sp
import IPython
import sklearn
from Grasshopper import DataTree
from Grasshopper.Kernel.Data import GH_Path

# Function to add text to a DataTree
def add_to_datatree(path, text, tree):
    tree.Add(text, path)

# Create a DataTree to store version information
version_info = DataTree[object]()

# Adding version information to the DataTree
add_to_datatree(GH_Path(0), "Python version: {}".format(sys.version), version_info)
add_to_datatree(GH_Path(1), "pandas version: {}".format(pd.__version__), version_info)
add_to_datatree(GH_Path(2), "matplotlib version: {}".format(matplotlib.__version__), version_info)
add_to_datatree(GH_Path(3), "NumPy version: {}".format(np.__version__), version_info)
add_to_datatree(GH_Path(4), "SciPy version: {}".format(sp.__version__), version_info)
add_to_datatree(GH_Path(5), "IPython version: {}".format(IPython.__version__), version_info)
add_to_datatree(GH_Path(6), "scikit-learn version: {}".format(sklearn.__version__), version_info)

# Output the DataTree
A = version_info
# ---------- end _1_6_ml_intro_mglearn_001c ----------
# Machine Learning Algorithm
# (***with ghpythonlib.treehelpers
# for DataTrees in gh***)
# Introduction
# mglearn
_1_6_ml_intro_mglearn_001 = Script()  # -> out, A
# ---------- _1_6_ml_intro_mglearn_001: Python ----------
import numpy as np
from Grasshopper import DataTree
from Grasshopper.Kernel.Data import GH_Path

# Generate synthetic data using numpy
x = np.linspace(-10, 10, 100)
y = np.sin(x) + np.random.normal(size=100) / 3

# Function to convert lists into a Grasshopper DataTree
def list_to_datatree(*lists):
    """ Convert lists to a Grasshopper DataTree """
    dt = DataTree[object]()
    for i, lst in enumerate(lists):
        path = GH_Path(i)
        for item in lst:
            dt.Add(item, path)
    return dt

# Store data in a DataTree
data_tree = list_to_datatree(x, y)

# Output the DataTree for further use in Grasshopper
A = data_tree
# ---------- end _1_6_ml_intro_mglearn_001 ----------
# MACHINE LEARNING IN GRASSHOPPER
# from DATAFRAMES to DATATREES
www_wickersonstudios_com = Script()  # -> out, A
# ---------- www_wickersonstudios_com: Python ----------
#! python3
#r: openpyxl, psycopg2, IPython

import rhinoscriptsyntax as rs
import scriptcontext as sc

import System
import System.Collections.Generic
import Rhino
'''
import locale
locale.setlocale(locale.LC_ALL, 'en_US')
import openpyxl
import psycopg2 
'''
#import pandas as pd
#print(pd.__version__)

import sys
import pandas as pd
import matplotlib
import numpy as np
import scipy as sp
import IPython
import sklearn
from Grasshopper import DataTree
from Grasshopper.Kernel.Data import GH_Path

# Function to add text to a DataTree
def add_to_datatree(path, text, tree):
    tree.Add(text, path)

# Create a DataTree to store version information
version_info = DataTree[object]()

# Adding version information to the DataTree
add_to_datatree(GH_Path(0), "Python version: {}".format(sys.version), version_info)
add_to_datatree(GH_Path(1), "pandas version: {}".format(pd.__version__), version_info)
add_to_datatree(GH_Path(2), "matplotlib version: {}".format(matplotlib.__version__), version_info)
add_to_datatree(GH_Path(3), "NumPy version: {}".format(np.__version__), version_info)
add_to_datatree(GH_Path(4), "SciPy version: {}".format(sp.__version__), version_info)
add_to_datatree(GH_Path(5), "IPython version: {}".format(IPython.__version__), version_info)
add_to_datatree(GH_Path(6), "scikit-learn version: {}".format(sklearn.__version__), version_info)

# Output the DataTree
A = version_info
# ---------- end www_wickersonstudios_com ----------
# import sys
# print(sys.path)
# 
# You will find where python is installed.
# They actually get a separated python 3.9 for
# Rhino8 for you (from what I see).
# 
# Then go to the directory of that python3.9,
# inside folder \Scripts you will find pip.
# Then go to cmd, cd to the directory of the
# \Scripts folder (The Rhino8 one).
# Then you can pip install whatever you want.
# I got matplotlib successfully installed in my case.
# 
# ADDITIONAL REQUIREMENTS:
# 
# #! python3
# #r: openpyxl, psycopg2
panel = Panel(_1_6_ml_intro_mglearn_001c.A)
# Created at
# Wickerson Studios
# copyright 2024
# download all materials at
# www.wickersonstudios.com
panel_2 = Panel(_1_6_ml_intro_mglearn_001.A)
panel_3 = Panel(www_wickersonstudios_com.A)
panel_4 = Panel(_1_6_ml_intro_mglearn_001.out)
list_length = ListLength(List=panel_2)
construct_domain = ConstructDomain(DomainStart=Slider(0, range=0..10), DomainEnd=Slider(10, range=0..10))
range = Range(Domain=construct_domain, Steps=expr("x-1", list_length))
construct_point = ConstructPoint(XCoordinate=range, YCoordinate=panel_2, ZCoordinate=0)
interpolate = Interpolate(Vertices=construct_point, Degree=3, Periodic=False, KnotStyle=1)  # -> Curve, Length, Domain
