# Grasshopper definition 2.0_ML_app_IRIS_001.gh (Grasshopper 1.0.8)
# plug-ins: RhinoCodePluginGH

# MACHINE LEARNING IN GRASSHOPPER
# from DATAFRAMES to DATATREES
www_wickersonstudios_com = Script()  # -> out, A
# ---------- www_wickersonstudios_com: Python ----------
#! python3
#r: openpyxl, psycopg2, IPython

import rhinoscriptsyntax as rs
import scriptcontext as sc

import System
import System.Collections.Generic
import Rhino
'''
import locale
locale.setlocale(locale.LC_ALL, 'en_US')
import openpyxl
import psycopg2 
'''
#import pandas as pd
#print(pd.__version__)

import sys
import pandas as pd
import matplotlib
import numpy as np
import scipy as sp
import IPython
import sklearn
from Grasshopper import DataTree
from Grasshopper.Kernel.Data import GH_Path

# Function to add text to a DataTree
def add_to_datatree(path, text, tree):
    tree.Add(text, path)

# Create a DataTree to store version information
version_info = DataTree[object]()

# Adding version information to the DataTree
add_to_datatree(GH_Path(0), "Python version: {}".format(sys.version), version_info)
add_to_datatree(GH_Path(1), "pandas version: {}".format(pd.__version__), version_info)
add_to_datatree(GH_Path(2), "matplotlib version: {}".format(matplotlib.__version__), version_info)
add_to_datatree(GH_Path(3), "NumPy version: {}".format(np.__version__), version_info)
add_to_datatree(GH_Path(4), "SciPy version: {}".format(sp.__version__), version_info)
add_to_datatree(GH_Path(5), "IPython version: {}".format(IPython.__version__), version_info)
add_to_datatree(GH_Path(6), "scikit-learn version: {}".format(sklearn.__version__), version_info)

# Output the DataTree
A = version_info
# ---------- end www_wickersonstudios_com ----------
# Created at
# Wickerson Studios
# copyright 2024
# download all materials at
# www.wickersonstudios.com
# Machine Learning Algorithm
# (***with ghpythonlib.treehelpers
# for DataTrees in gh***)
# Introduction
# Application: IRIS
# import sys
# print(sys.path)
# 
# You will find where python is installed.
# They actually get a separated python 3.9 for
# Rhino8 for you (from what I see).
# 
# Then go to the directory of that python3.9,
# inside folder \Scripts you will find pip.
# Then go to cmd, cd to the directory of the
# \Scripts folder (The Rhino8 one).
# Then you can pip install whatever you want.
# I got matplotlib successfully installed in my case.
# 
# ADDITIONAL REQUIREMENTS:
# 
# #! python3
# #r: openpyxl, psycopg2
# Machine Leanring in Python 3.0 NEW
# Script Editor in Rhino8 at
# Wickerson Studios
# 
# upload everything to date at:
# www.wickersonstudios.com
panel = Panel(www_wickersonstudios_com.A)
