# Grasshopper definition 2.1_ML_classificationRegression_001.gh (Grasshopper 1.0.8)
# plug-ins: RhinoCodePluginGH

# MACHINE LEARNING IN GRASSHOPPER
# from DATAFRAMES to DATATREES
www_wickersonstudios_com = Script()  # -> out, A
# ---------- www_wickersonstudios_com: Python ----------
#! python3


import rhinoscriptsyntax as rs
import scriptcontext as sc

import System
import System.Collections.Generic
import Rhino
'''
import locale
locale.setlocale(locale.LC_ALL, 'en_US')
import openpyxl
import psycopg2 
'''
#import pandas as pd
#print(pd.__version__)

import sys
import pandas as pd
#import matplotlib
import numpy as np
import scipy as sp
import IPython
import sklearn
from Grasshopper import DataTree
from Grasshopper.Kernel.Data import GH_Path

# Function to add text to a DataTree
def add_to_datatree(path, text, tree):
    tree.Add(text, path)

# Create a DataTree to store version information
version_info = DataTree[object]()

# Adding version information to the DataTree
add_to_datatree(GH_Path(0), "Python version: {}".format(sys.version), version_info)
add_to_datatree(GH_Path(1), "pandas version: {}".format(pd.__version__), version_info)
#add_to_datatree(GH_Path(2), "matplotlib version: {}".format(matplotlib.__version__), version_info)
add_to_datatree(GH_Path(3), "NumPy version: {}".format(np.__version__), version_info)
add_to_datatree(GH_Path(4), "SciPy version: {}".format(sp.__version__), version_info)
add_to_datatree(GH_Path(5), "IPython version: {}".format(IPython.__version__), version_info)
add_to_datatree(GH_Path(6), "scikit-learn version: {}".format(sklearn.__version__), version_info)

# Output the DataTree
A = version_info
# ---------- end www_wickersonstudios_com ----------
# import sys
# print(sys.path)
# 
# You will find where python is installed.
# They actually get a separated python 3.9 for
# Rhino8 for you (from what I see).
# 
# Then go to the directory of that python3.9,
# inside folder \Scripts you will find pip.
# Then go to cmd, cd to the directory of the
# \Scripts folder (The Rhino8 one).
# Then you can pip install whatever you want.
# I got matplotlib successfully installed in my case.
# 
# ADDITIONAL REQUIREMENTS:
# 
# #! python3
# #r: openpyxl, psycopg2
panel = Panel(www_wickersonstudios_com.A)
# Created at
# Wickerson Studios
# copyright 2024
# download all materials at
# www.wickersonstudios.com
_2_1_ml_classification_001 = Script()  # -> out, A, B
# ---------- _2_1_ml_classification_001: Python ----------
import rhinoscriptsyntax as rs
import scriptcontext as sc

import System
import System.Collections.Generic
import Rhino
from Grasshopper import DataTree
from Grasshopper.Kernel.Data import GH_Path
from sklearn.datasets import load_iris
from sklearn.model_selection import train_test_split
from sklearn.preprocessing import StandardScaler
from sklearn.neighbors import KNeighborsClassifier
from sklearn.metrics import confusion_matrix, classification_report
import numpy as np

# Load the Iris dataset
iris = load_iris()
X = iris.data
y = iris.target

# Split the dataset
X_train, X_test, y_train, y_test = train_test_split(X, y, test_size=0.2, random_state=42)

# Optionally scale features
scaler = StandardScaler()
X_train = scaler.fit_transform(X_train)
X_test = scaler.transform(X_test)

# Initialize the k-NN model
knn = KNeighborsClassifier(n_neighbors=3)

# Train the model
knn.fit(X_train, y_train)

# Predict on the test data
y_pred = knn.predict(X_test)

# Evaluate the model
conf_matrix = confusion_matrix(y_test, y_pred)
class_report = classification_report(y_test, y_pred)

# Function to convert arrays or matrices to DataTree
def list_to_datatree(lst, tree, path):
    if isinstance(lst, list) or isinstance(lst, np.ndarray):
        for i, item in enumerate(lst):
            p = GH_Path(*path.Indices, i)
            list_to_datatree(item, tree, p)
    else:
        tree.Add(lst, path)

# Create DataTrees for output
conf_matrix_tree = DataTree[object]()
class_report_tree = DataTree[object]()

# Adding data to DataTrees
list_to_datatree(conf_matrix, conf_matrix_tree, GH_Path(0))
list_to_datatree(class_report.split('\n'), class_report_tree, GH_Path(0))

# Output the DataTrees
A = conf_matrix_tree
B = class_report_tree
# ---------- end _2_1_ml_classification_001 ----------
# Machine Learning Algorithm
# (***with ghpythonlib.treehelpers
# for DataTrees in gh***)
# Introduction
# Application: IRIS
# MACHINE LEARNING
# Classification and Regression
# upload all files at
# www.wickersonstudios.com
param_viewer = ParamViewer(_2_1_ml_classification_001.A)
param_viewer_2 = ParamViewer(_2_1_ml_classification_001.B)
panel_2 = Panel(_2_1_ml_classification_001.B)
panel_3 = Panel(_2_1_ml_classification_001.A)
