# Grasshopper definition 2.3_ML_2classificationDataset_001.gh (Grasshopper 1.0.8)
# plug-ins: RhinoCodePluginGH, Bifocals

# MACHINE LEARNING IN GRASSHOPPER
# from DATAFRAMES to DATATREES
www_wickersonstudios_com = Script()  # -> out, A
# ---------- www_wickersonstudios_com: Python ----------
#! python3


import rhinoscriptsyntax as rs
import scriptcontext as sc

import System
import System.Collections.Generic
import Rhino
'''
import locale
locale.setlocale(locale.LC_ALL, 'en_US')
import openpyxl
import psycopg2 
'''
#import pandas as pd
#print(pd.__version__)

import sys
import pandas as pd
#import matplotlib
import numpy as np
import scipy as sp
import IPython
import sklearn
from Grasshopper import DataTree
from Grasshopper.Kernel.Data import GH_Path

# Function to add text to a DataTree
def add_to_datatree(path, text, tree):
    tree.Add(text, path)

# Create a DataTree to store version information
version_info = DataTree[object]()

# Adding version information to the DataTree
add_to_datatree(GH_Path(0), "Python version: {}".format(sys.version), version_info)
add_to_datatree(GH_Path(1), "pandas version: {}".format(pd.__version__), version_info)
#add_to_datatree(GH_Path(2), "matplotlib version: {}".format(matplotlib.__version__), version_info)
add_to_datatree(GH_Path(3), "NumPy version: {}".format(np.__version__), version_info)
add_to_datatree(GH_Path(4), "SciPy version: {}".format(sp.__version__), version_info)
add_to_datatree(GH_Path(5), "IPython version: {}".format(IPython.__version__), version_info)
add_to_datatree(GH_Path(6), "scikit-learn version: {}".format(sklearn.__version__), version_info)

# Output the DataTree
A = version_info
# ---------- end www_wickersonstudios_com ----------
# Created at
# Wickerson Studios
# copyright 2024
# download all materials at
# www.wickersonstudios.com
# import sys
# print(sys.path)
# 
# You will find where python is installed.
# They actually get a separated python 3.9 for
# Rhino8 for you (from what I see).
# 
# Then go to the directory of that python3.9,
# inside folder \Scripts you will find pip.
# Then go to cmd, cd to the directory of the
# \Scripts folder (The Rhino8 one).
# Then you can pip install whatever you want.
# I got matplotlib successfully installed in my case.
# 
# ADDITIONAL REQUIREMENTS:
# 
# #! python3
# #r: openpyxl, psycopg2
panel = Panel(www_wickersonstudios_com.A)
# MACHINE LEARNING
# two-class classification dataset
# upload all files at
# www.wickersonstudios.com
number_slider = Slider(21, range=0..100)
# Machine Learning Algorithm
# (***with ghpythonlib.treehelpers
# for DataTrees in gh***)
# Introduction
# Application: IRIS
_2_3_ml_2classificationdataset_001 = Script(samplesIn=number_slider)  # -> out, Ax, Ay, B, C; inputs samplesIn: Int32
# ---------- _2_3_ml_2classificationdataset_001: Python ----------
import rhinoscriptsyntax as rs
import scriptcontext as sc

import System
import System.Collections.Generic
import Rhino
import numpy as np
from sklearn.datasets import make_classification
from Grasshopper import DataTree
from Grasshopper.Kernel.Data import GH_Path

# Function to add any object to a DataTree
def add_to_datatree(tree, path, data):
    for item in data:
        tree.Add(item, path)

# Create DataTrees to store data
features_tree_x = DataTree[object]()  # DataTree for the x-component of features
features_tree_y = DataTree[object]()  # DataTree for the y-component of features
labels_tree = DataTree[object]()

# Generate dataset
X, y = make_classification(n_samples=samplesIn, n_features=2, n_informative=2, n_redundant=0, n_clusters_per_class=1)

# Split X into x and y components and add to their respective DataTrees
for index, (x, y_feature) in enumerate(X):
    add_to_datatree(features_tree_x, GH_Path(0), [x])
    add_to_datatree(features_tree_y, GH_Path(0), [y_feature])

# Add labels to DataTree
add_to_datatree(labels_tree, GH_Path(0), y)

# Output the DataTrees
Ax = features_tree_x
Ay = features_tree_y
B = labels_tree
C = "X.shape: {}".format(X.shape)
# ---------- end _2_3_ml_2classificationdataset_001 ----------
param_viewer = ParamViewer(_2_3_ml_2classificationdataset_001.Ax)
panel_2 = Panel(_2_3_ml_2classificationdataset_001.Ax)
param_viewer_2 = ParamViewer(_2_3_ml_2classificationdataset_001.C)
panel_3 = Panel(_2_3_ml_2classificationdataset_001.C)
panel_4 = Panel(_2_3_ml_2classificationdataset_001.Ay)
param_viewer_3 = ParamViewer(_2_3_ml_2classificationdataset_001.B)
panel_5 = Panel(_2_3_ml_2classificationdataset_001.B)

# ----
# Data Visualization
construct_point = ConstructPoint(XCoordinate=_2_3_ml_2classificationdataset_001.Ax, YCoordinate=_2_3_ml_2classificationdataset_001.Ay, ZCoordinate=0)
number_slider_2 = Slider(0.116, range=0..1)
dispatch = Dispatch(List=construct_point, DispatchPattern=panel_5)  # -> ListA, ListB
polygon = Polygon(Plane=dispatch.ListB, Radius=number_slider_2, Segments="3", FilletRadius=0)  # -> Polygon, Length
circle = Circle(Plane=dispatch.ListA, Radius=number_slider_2)
boundary_surfaces = BoundarySurfaces(Edges=circle)
boundary_surfaces_2 = BoundarySurfaces(Edges=polygon.Polygon)
custom_preview = CustomPreview(Geometry=boundary_surfaces, Material=ColourSwatch(SwatchColor=RGB(255, 0, 255)))
custom_preview_2 = CustomPreview(Geometry=boundary_surfaces_2, Material=ColourSwatch(SwatchColor=RGB(0, 0, 255)))
