# Grasshopper definition 2.4_ML_kerasTensorflow_001b.gh (Grasshopper 1.0.8)
# plug-ins: RhinoCodePluginGH

# import sys
# print(sys.path)
# 
# You will find where python is installed.
# They actually get a separated python 3.9 for
# Rhino8 for you (from what I see).
# 
# Then go to the directory of that python3.9,
# inside folder \Scripts you will find pip.
# Then go to cmd, cd to the directory of the
# \Scripts folder (The Rhino8 one).
# Then you can pip install whatever you want.
# I got matplotlib successfully installed in my case.
# 
# ADDITIONAL REQUIREMENTS:
# 
# #! python3
# #r: openpyxl, psycopg2
# MACHINE LEARNING IN GRASSHOPPER
# from DATAFRAMES to DATATREES
www_wickersonstudios_com = Script()  # -> out, A
# ---------- www_wickersonstudios_com: Python ----------
#! python3
#r: openpyxl, psycopg2, IPython

import rhinoscriptsyntax as rs
import scriptcontext as sc
import System
import System.Collections.Generic
import Rhino

import sys
import pandas as pd
from matplotlib import pyplot as plt
import numpy as np
import scipy as sp
import IPython
import sklearn
import tensorflow as tf
import keras
from Grasshopper import DataTree
from Grasshopper.Kernel.Data import GH_Path

# Function to add text to a DataTree
def add_to_datatree(path, text, tree):
    tree.Add(text, path)

# Create a DataTree to store version information
version_info = DataTree[object]()

# Adding version information to the DataTree
add_to_datatree(GH_Path(0), "Python version: {}".format(sys.version), version_info)
add_to_datatree(GH_Path(1), "pandas version: {}".format(pd.__version__), version_info)
#add_to_datatree(GH_Path(2), "matplotlib version: {}".format(matplotlib.__version__), version_info)
add_to_datatree(GH_Path(3), "NumPy version: {}".format(np.__version__), version_info)
add_to_datatree(GH_Path(4), "SciPy version: {}".format(sp.__version__), version_info)
add_to_datatree(GH_Path(5), "IPython version: {}".format(IPython.__version__), version_info)
add_to_datatree(GH_Path(6), "scikit-learn version: {}".format(sklearn.__version__), version_info)
add_to_datatree(GH_Path(7), "Keras version: {}".format(keras.__version__), version_info)
add_to_datatree(GH_Path(8), "TensorFlow version: {}".format(tf.__version__), version_info)

# Output the DataTree
A = version_info
# ---------- end www_wickersonstudios_com ----------
panel = Panel(www_wickersonstudios_com.A)
# Created at
# Wickerson Studios
# copyright 2024
# download all materials at
# www.wickersonstudios.com
# Machine Learning Algorithm
# (***with ghpythonlib.treehelpers
# for DataTrees in gh***)
# Introduction
# MACHINE LEARNING
# Keras & Tensorfow
# upload all files at
# www.wickersonstudios.com
epochs = Slider(100, range=0..100)
neurons = Slider(10, range=0..10)
_2_4_ml_keras_001b = Script(epochsIn=epochs, neuronsIn=neurons)  # -> out, xOut, yOut, C, D; inputs epochsIn: Int32, neuronsIn: Int32
# ---------- _2_4_ml_keras_001b: Python ----------
#! python3
#r: openpyxl, psycopg2, IPython

import rhinoscriptsyntax as rs
import scriptcontext as sc
import System
import Rhino
import numpy as np
from keras.models import Sequential
from keras.layers import Dense
from Grasshopper import DataTree
from Grasshopper.Kernel.Data import GH_Path

# Function to generate synthetic data
def generate_data():
    # Generate data points (x) between 0 to 1
    x = np.linspace(0, 1, 100)
    # Generate corresponding y values based on the equation y = 2x + noise
    noise = np.random.normal(0, 0.1, x.shape)
    y = 2 * x + noise
    return x, y

# Function to create and train a neural network
def train_model(x, y, neurons, epochs):
    # Create a Sequential model
    model = Sequential([
        Dense(neurons, activation='relu', input_shape=(1,)),
        Dense(1)
    ])
    # Compile the model
    model.compile(optimizer='adam', loss='mse')
    # Train the model
    model.fit(x, y, epochs=epochs, verbose=0)
    return model

# Function to predict using the model
def predict_values(model, x_values):
    # Predict using the trained model on a range of x values
    predictions = model.predict(np.array(x_values))
    return predictions

# Retrieve input parameters from Grasshopper or use default values
epochs = sc.sticky.get('epochs', epochsIn)  # Default to 100 epochs if not specified
neurons = sc.sticky.get('neurons', neuronsIn)  # Default to 10 neurons if not specified

# Main script execution
x, y = generate_data()  # Generate synthetic data
model = train_model(x, y, neurons, epochs)  # Train the model with specified parameters
x_test = np.linspace(0, 1, 50)  # Generate new x values for prediction
predicted_y = predict_values(model, x_test)  # Predict y values for the test x

# Output the original and predicted data
xOut = x.tolist()  # Original x values
yOut = y.tolist()  # Original y values
B = x_test.tolist()  # Test x values
C = predicted_y.flatten().tolist()  # Predicted y values for test x

# Example of creating a line curve from predicted data
D = rs.AddCurve([Rhino.Geometry.Point3d(xi, yi, 0) for xi, yi in zip(B, C)], degree=3)
# ---------- end _2_4_ml_keras_001b ----------
curve = Curve(_2_4_ml_keras_001b.D)
construct_point = ConstructPoint(XCoordinate=_2_4_ml_keras_001b.xOut, YCoordinate=_2_4_ml_keras_001b.yOut, ZCoordinate=0)
panel_2 = Panel(curve)
panel_3 = Panel(_2_4_ml_keras_001b.xOut)
_2_4_ml_keras_001 = Script()  # -> out, A
# ---------- _2_4_ml_keras_001: Python ----------
#! python3
#r: openpyxl, psycopg2, IPython

import rhinoscriptsyntax as rs
import scriptcontext as sc
import System
import Rhino
import numpy as np
import keras
from keras.models import Sequential
from keras.layers import Dense
from Grasshopper import DataTree
from Grasshopper.Kernel.Data import GH_Path

# Function to generate synthetic data
def generate_data():
    # Generate 100 data points (x) between 0 to 1
    x = np.linspace(0, 1, 100)
    # Generate corresponding y values based on the equation y = 2x + noise
    noise = np.random.normal(0, 0.1, x.shape)
    y = 2 * x + noise
    return x, y

# Function to create and train a simple neural network
def train_model(x, y):
    # Create a Sequential model
    model = Sequential([
        Dense(10, activation='relu', input_shape=(1,)),
        Dense(1)
    ])
    # Compile the model
    model.compile(optimizer='adam', loss='mse')
    # Train the model
    model.fit(x, y, epochs=50, verbose=0)
    return model

# Function to predict using the model
def predict_value(model, new_x):
    # Predict using the trained model
    prediction = model.predict(np.array([new_x]))
    return prediction

# Main script
x, y = generate_data()  # Generate synthetic data
model = train_model(x, y)  # Train the model
predicted_value = predict_value(model, 0.5)  # Predict value for x = 0.5

# Output the predicted value
A = predicted_value
# ---------- end _2_4_ml_keras_001 ----------
panel_4 = Panel(_2_4_ml_keras_001b.out)
panel_5 = Panel(_2_4_ml_keras_001.A)
panel_6 = Panel(_2_4_ml_keras_001b.yOut)
panel_7 = Panel(_2_4_ml_keras_001b.C)
