# Grasshopper definition 3.0_ML_Ng_CourseWeekLesson_112.gh (Grasshopper 1.0.8)
# plug-ins: RhinoCodePluginGH

# ----
# Created at
# Wickerson Studios
# copyright 2024
# download all materials at
# www.wickersonstudios.com
# import sys
# print(sys.path)
# 
# You will find where python is installed.
# They actually get a separated python 3.9 for
# Rhino8 for you (from what I see).
# 
# Then go to the directory of that python3.9,
# inside folder \Scripts you will find pip.
# Then go to cmd, cd to the directory of the
# \Scripts folder (The Rhino8 one).
# Then you can pip install whatever you want.
# I got matplotlib successfully installed in my case.
# 
# EXAMPLE ADDITIONAL REQUIREMENTS:
# 
# #! python3
# #r: openpyxl, psycopg2
# MACHINE LEARNING IN GRASSHOPPER
# PANDAS
# 
# NUMPY
# 
# SCIPY
# 
# IPYTHON
# 
# SCIKIT-LEARN
# 
# KERAS
# 
# TENSORFLOW
# from DATAFRAMES to DATATREES
www_wickersonstudios_com = Script()  # -> out, A
# ---------- www_wickersonstudios_com: Python ----------
#! python3
#r: openpyxl, psycopg2, IPython

import rhinoscriptsyntax as rs
import scriptcontext as sc
import System
import System.Collections.Generic
import Rhino

import sys
import pandas as pd
from matplotlib import pyplot as plt
import numpy as np
import scipy as sp
import IPython
import sklearn
import tensorflow as tf
import keras
from Grasshopper import DataTree
from Grasshopper.Kernel.Data import GH_Path

# Function to add text to a DataTree
def add_to_datatree(path, text, tree):
    tree.Add(text, path)

# Create a DataTree to store version information
version_info = DataTree[object]()

# Adding version information to the DataTree
add_to_datatree(GH_Path(0), "Python version: {}".format(sys.version), version_info)
add_to_datatree(GH_Path(1), "pandas version: {}".format(pd.__version__), version_info)
#add_to_datatree(GH_Path(2), "matplotlib version: {}".format(matplotlib.__version__), version_info)
add_to_datatree(GH_Path(3), "NumPy version: {}".format(np.__version__), version_info)
add_to_datatree(GH_Path(4), "SciPy version: {}".format(sp.__version__), version_info)
add_to_datatree(GH_Path(5), "IPython version: {}".format(IPython.__version__), version_info)
add_to_datatree(GH_Path(6), "scikit-learn version: {}".format(sklearn.__version__), version_info)
add_to_datatree(GH_Path(7), "Keras version: {}".format(keras.__version__), version_info)
add_to_datatree(GH_Path(8), "TensorFlow version: {}".format(tf.__version__), version_info)

# Output the DataTree
A = version_info
# ---------- end www_wickersonstudios_com ----------
panel = Panel(www_wickersonstudios_com.A)

# ----
# Course 1 / Week 1 / Lesson 2
checkerboard_002 = Script()  # -> out, A, B
# ---------- checkerboard_002: Python ----------
#! python3
#r: openpyxl, psycopg2, IPython

import rhinoscriptsyntax as rs
import scriptcontext as sc
import System
import System.Collections.Generic
import Rhino

import sys
import pandas as pd
from matplotlib import pyplot as plt
import numpy as np
import scipy as sp
import IPython
import sklearn
import tensorflow as tf
import keras
from Grasshopper import DataTree
from Grasshopper.Kernel.Data import GH_Path

# Initialize the board with integers indicating player pieces
def init_board():
    board = np.zeros((8, 8), dtype=int)
    for i in range(8):
        if i % 2 == 0:
            board[i][1::2] = 1 if i < 3 else 2 if i > 4 else 0
        else:
            board[i][0::2] = 1 if i < 3 else 2 if i > 4 else 0
    return board

# Add board state to a DataTree
def print_board_to_datatree(board, tree, path):
    for i in range(8):
        for j in range(8):
            tree.Add(board[i][j], GH_Path(path, i))

# Function to add text to a DataTree
def add_to_datatree(path, text, tree):
    tree.Add(text, path)

# Create DataTrees for output
version_info = DataTree[object]()
game_state = DataTree[object]()

# Populate version information
add_to_datatree(GH_Path(0), "Python version: {}".format(sys.version), version_info)
add_to_datatree(GH_Path(1), "pandas version: {}".format(pd.__version__), version_info)
add_to_datatree(GH_Path(2), "NumPy version: {}".format(np.__version__), version_info)
add_to_datatree(GH_Path(3), "SciPy version: {}".format(sp.__version__), version_info)
add_to_datatree(GH_Path(4), "IPython version: {}".format(IPython.__version__), version_info)
add_to_datatree(GH_Path(5), "scikit-learn version: {}".format(sklearn.__version__), version_info)
add_to_datatree(GH_Path(6), "Keras version: {}".format(keras.__version__), version_info)
add_to_datatree(GH_Path(7), "TensorFlow version: {}".format(tf.__version__), version_info)

# Initialize game board and add board state to DataTree
board = init_board()
print_board_to_datatree(board, game_state, 0)

# Outputs
A = version_info
B = game_state
# ---------- end checkerboard_002 ----------
# Machine Learning
# Interpreting  Machine Learning
# Specialization YouTube Course
# by Andrew Ng
# into Grasshopper Canvas and
# Rhino8 Environment at
# Wickerson Studios
# Gh_files uploads at
# www.wickersonstudios.com
panel_2 = Panel(checkerboard_002.B)

# ----
# data visualization
panel_3 = Panel("{0;0}")
tree_branch = TreeBranch(Tree=checkerboard_002.B, Path=panel_3, MaintainPaths=True)
tree_statistics = TreeStatistics(Tree=checkerboard_002.B)  # -> Paths, Length, Count
list_length = ListLength(List=tree_branch)
list_length_2 = ListLength(List=tree_statistics.Paths)
square = Square(Plane=PlaneXY(0, 0, 0), Size=1, ExtentX=list_length, ExtentY=list_length_2)  # -> Cells, Points
area = Area(Geometry=square.Cells)  # -> Area, Centroid
circle = Circle(Plane=PlaneXY(0, 0, 0), Radius=Slider(0.5, range=0..1))
orient = Orient(Geometry=circle, Source=PlaneXY(0, 0, 0), Target=area.Centroid)  # -> Geometry, Transform
dispatch = Dispatch(List=orient.Geometry, DispatchPattern=panel_2)  # -> ListA, ListB
geometry = Geometry(dispatch.ListA)
geometry_2 = Geometry(dispatch.ListB)
split_list = SplitList(List=flatten(geometry), Index="12")  # -> ListA, ListB
geometry_3 = Geometry(split_list.ListA)
geometry_4 = Geometry(split_list.ListB)
boundary_surfaces = BoundarySurfaces(Edges=geometry_3)
boundary_surfaces_2 = BoundarySurfaces(Edges=geometry_4)

panel_4 = Panel(checkerboard_002.A)
