# Grasshopper definition 3.0_ML_Ng_CourseWeekLesson_112b.gh (Grasshopper 1.0.8)
# plug-ins: RhinoCodePluginGH

# ----
# Created at
# Wickerson Studios
# copyright 2024
# download all materials at
# www.wickersonstudios.com
# import sys
# print(sys.path)
# 
# You will find where python is installed.
# They actually get a separated python 3.9 for
# Rhino8 for you (from what I see).
# 
# Then go to the directory of that python3.9,
# inside folder \Scripts you will find pip.
# Then go to cmd, cd to the directory of the
# \Scripts folder (The Rhino8 one).
# Then you can pip install whatever you want.
# I got matplotlib successfully installed in my case.
# 
# EXAMPLE ADDITIONAL REQUIREMENTS:
# 
# #! python3
# #r: openpyxl, psycopg2
# MACHINE LEARNING IN GRASSHOPPER
# PANDAS
# 
# NUMPY
# 
# SCIPY
# 
# IPYTHON
# 
# SCIKIT-LEARN
# 
# KERAS
# 
# TENSORFLOW
# from DATAFRAMES to DATATREES
www_wickersonstudios_com = Script()  # -> out, A
# ---------- www_wickersonstudios_com: Python ----------
#! python3
#r: openpyxl, psycopg2, IPython

import rhinoscriptsyntax as rs
import scriptcontext as sc
import System
import System.Collections.Generic
import Rhino

import sys
import pandas as pd
from matplotlib import pyplot as plt
import numpy as np
import scipy as sp
import IPython
import sklearn
import tensorflow as tf
import keras
from Grasshopper import DataTree
from Grasshopper.Kernel.Data import GH_Path

# Function to add text to a DataTree
def add_to_datatree(path, text, tree):
    tree.Add(text, path)

# Create a DataTree to store version information
version_info = DataTree[object]()

# Adding version information to the DataTree
add_to_datatree(GH_Path(0), "Python version: {}".format(sys.version), version_info)
add_to_datatree(GH_Path(1), "pandas version: {}".format(pd.__version__), version_info)
#add_to_datatree(GH_Path(2), "matplotlib version: {}".format(matplotlib.__version__), version_info)
add_to_datatree(GH_Path(3), "NumPy version: {}".format(np.__version__), version_info)
add_to_datatree(GH_Path(4), "SciPy version: {}".format(sp.__version__), version_info)
add_to_datatree(GH_Path(5), "IPython version: {}".format(IPython.__version__), version_info)
add_to_datatree(GH_Path(6), "scikit-learn version: {}".format(sklearn.__version__), version_info)
add_to_datatree(GH_Path(7), "Keras version: {}".format(keras.__version__), version_info)
add_to_datatree(GH_Path(8), "TensorFlow version: {}".format(tf.__version__), version_info)

# Output the DataTree
A = version_info
# ---------- end www_wickersonstudios_com ----------
panel = Panel(www_wickersonstudios_com.A)

# ----
# Machine Learning
# Interpreting  Machine Learning
# Specialization YouTube Course
# by Andrew Ng
# into Grasshopper Canvas and
# Rhino8 Environment at
# Wickerson Studios
# Gh_files uploads at
# www.wickersonstudios.com
# Course 1 / Week 1 / Lesson 2 part 2
regression_001 = Script()  # -> out, A, B, C, D, E, F
# ---------- regression_001: Python ----------
#! python3
#r: openpyxl, psycopg2, IPython

import rhinoscriptsyntax as rs
import scriptcontext as sc
import System
from System.Collections.Generic import List
import Rhino

import sys
import pandas as pd
import numpy as np
import scipy as sp
import IPython
import sklearn
from sklearn.model_selection import train_test_split
from sklearn.linear_model import LinearRegression
from sklearn.datasets import make_regression
from keras.models import Sequential
from keras.layers import Dense
import tensorflow as tf
from Grasshopper import DataTree
from Grasshopper.Kernel.Data import GH_Path

# Function to add a list of numbers to a DataTree
def add_list_to_datatree(path, items, tree):
    for item in items:
        tree.Add(item, GH_Path(path))

# Generate a simple regression dataset
X, y = make_regression(n_samples=1000, n_features=1, noise=10.0, random_state=42)
X = X.flatten()

# Split the dataset into training and testing sets
X_train, X_test, y_train, y_test = train_test_split(X, y, test_size=0.2, random_state=42)

# Initialize and train a linear regression model
model = LinearRegression()
model.fit(X_train.reshape(-1, 1), y_train)

# Predict housing prices
predictions = model.predict(X_test.reshape(-1, 1))

# Create DataTrees for output
x_train_tree = DataTree[object]()
y_train_tree = DataTree[object]()
x_test_tree = DataTree[object]()
y_test_tree = DataTree[object]()
model_info = DataTree[object]()
predictions_tree = DataTree[object]()

# Add data to DataTrees
add_list_to_datatree(0, X_train, x_train_tree)
add_list_to_datatree(0, y_train, y_train_tree)
add_list_to_datatree(0, X_test, x_test_tree)
add_list_to_datatree(0, y_test, y_test_tree)
model_info.AddRange([model.coef_[0], model.intercept_], GH_Path(0))
predictions_tree.AddRange(predictions, GH_Path(0))

# Outputs
A = x_train_tree
B = y_train_tree
C = x_test_tree
D = y_test_tree
E = model_info
F = predictions_tree
# ---------- end regression_001 ----------
# data visualization
construct_point = ConstructPoint(XCoordinate=regression_001.A, YCoordinate=regression_001.B, ZCoordinate=0)
construct_point_2 = ConstructPoint(XCoordinate=regression_001.C, YCoordinate=regression_001.D, ZCoordinate=0)
panel_2 = Panel(regression_001.A)
regression_001_2 = Script(new_x_input=Slider(0.6, range=0..10))  # -> out, G, Hx, Hy; inputs new_x_input: Double
# ---------- regression_001_2: Python ----------
#! python3
#r: openpyxl, psycopg2, IPython

import rhinoscriptsyntax as rs
import scriptcontext as sc
import System
from System.Collections.Generic import List
import Rhino

import sys
import pandas as pd
import numpy as np
import scipy as sp
import IPython
import sklearn
from sklearn.model_selection import train_test_split
from sklearn.linear_model import LinearRegression
from sklearn.datasets import make_regression
from keras.models import Sequential
from keras.layers import Dense
import tensorflow as tf
from Grasshopper import DataTree
from Grasshopper.Kernel.Data import GH_Path

# Function to add items to a DataTree
def add_to_datatree(path, item, tree):
    tree.Add(item, GH_Path(path))

# Generate a simple regression dataset
X, y = make_regression(n_samples=1000, n_features=1, noise=10.0, random_state=42)
X = X.flatten()

# Split the dataset into training and testing sets
X_train, X_test, y_train, y_test = train_test_split(X, y, test_size=0.2, random_state=42)

# Initialize and train a linear regression model
model = LinearRegression()
model.fit(X_train.reshape(-1, 1), y_train)

# Create DataTrees for output
model_info = DataTree[object]()
hx_output = DataTree[object]()
hy_output = DataTree[object]()

# Model coefficients and intercept
model_info.AddRange([model.coef_[0], model.intercept_], GH_Path(0))

# Function to make predictions based on new x input
def predict_new_x(new_x):
    new_y = model.predict([[new_x]])
    return new_x, new_y[0]

# Accept input for new x value, this should be set from Grasshopper
#new_x_input = 1.5  # Example value, replace this with Grasshopper input
predicted_x, predicted_y = predict_new_x(new_x_input)
add_to_datatree(0, predicted_x, hx_output)
add_to_datatree(0, predicted_y, hy_output)

# Outputs
G = model_info
Hx = hx_output
Hy = hy_output
# ---------- end regression_001_2 ----------
panel_3 = Panel(regression_001.B)
panel_4 = Panel(regression_001_2.G)
panel_5 = Panel(regression_001.C)
panel_6 = Panel([regression_001_2.Hx, regression_001_2.Hy])
construct_point_3 = ConstructPoint(XCoordinate=regression_001_2.Hx, YCoordinate=regression_001_2.Hy, ZCoordinate=0)
panel_7 = Panel(regression_001.D)
circle = Circle(Plane=construct_point_3, Radius="3")
panel_8 = Panel(regression_001.E)
boundary_surfaces = BoundarySurfaces(Edges=circle)
panel_9 = Panel(regression_001.F)
