# Grasshopper definition 3.0_ML_Ng_CourseWeekLesson_112c.gh (Grasshopper 1.0.8)
# plug-ins: RhinoCodePluginGH

# ----
# Created at
# Wickerson Studios
# copyright 2024
# download all materials at
# www.wickersonstudios.com
# import sys
# print(sys.path)
# 
# You will find where python is installed.
# They actually get a separated python 3.9 for
# Rhino8 for you (from what I see).
# 
# Then go to the directory of that python3.9,
# inside folder \Scripts you will find pip.
# Then go to cmd, cd to the directory of the
# \Scripts folder (The Rhino8 one).
# Then you can pip install whatever you want.
# I got matplotlib successfully installed in my case.
# 
# EXAMPLE ADDITIONAL REQUIREMENTS:
# 
# #! python3
# #r: openpyxl, psycopg2
# MACHINE LEARNING IN GRASSHOPPER
# PANDAS
# 
# NUMPY
# 
# SCIPY
# 
# IPYTHON
# 
# SCIKIT-LEARN
# 
# KERAS
# 
# TENSORFLOW
# from DATAFRAMES to DATATREES
www_wickersonstudios_com = Script()  # -> out, A
# ---------- www_wickersonstudios_com: Python ----------
#! python3
#r: openpyxl, psycopg2, IPython

import rhinoscriptsyntax as rs
import scriptcontext as sc
import System
import System.Collections.Generic
import Rhino

import sys
import pandas as pd
from matplotlib import pyplot as plt
import numpy as np
import scipy as sp
import IPython
import sklearn
import tensorflow as tf
import keras
from Grasshopper import DataTree
from Grasshopper.Kernel.Data import GH_Path

# Function to add text to a DataTree
def add_to_datatree(path, text, tree):
    tree.Add(text, path)

# Create a DataTree to store version information
version_info = DataTree[object]()

# Adding version information to the DataTree
add_to_datatree(GH_Path(0), "Python version: {}".format(sys.version), version_info)
add_to_datatree(GH_Path(1), "pandas version: {}".format(pd.__version__), version_info)
#add_to_datatree(GH_Path(2), "matplotlib version: {}".format(matplotlib.__version__), version_info)
add_to_datatree(GH_Path(3), "NumPy version: {}".format(np.__version__), version_info)
add_to_datatree(GH_Path(4), "SciPy version: {}".format(sp.__version__), version_info)
add_to_datatree(GH_Path(5), "IPython version: {}".format(IPython.__version__), version_info)
add_to_datatree(GH_Path(6), "scikit-learn version: {}".format(sklearn.__version__), version_info)
add_to_datatree(GH_Path(7), "Keras version: {}".format(keras.__version__), version_info)
add_to_datatree(GH_Path(8), "TensorFlow version: {}".format(tf.__version__), version_info)

# Output the DataTree
A = version_info
# ---------- end www_wickersonstudios_com ----------
panel = Panel(www_wickersonstudios_com.A)

# ----
# data visualization
testdata_1 = Panel("""12.47
18.6
81.09
481.9
0.09965
0.1058
0.08005
0.03821
0.1925
0.06373
0.3961
1.044
2.497
30.29
0.006953
0.01911
0.02701
0.01037
0.01782
0.003586
14.97
24.64
96.05
677.9
0.1426
0.2378
0.2671
0.1015
0.3014
0.0875""")
testdata_2 = Panel("""18.94
21.31
123.6
1130.0
0.09009
0.1029
0.108
0.07951
0.1582
0.05461
0.7888
0.7975
5.486
96.05
0.004444
0.01652
0.02269
0.0137
0.01386
0.001698
24.86
26.58
165.9
1866.0
0.1193
0.2336
0.2687
0.1789
0.2551
0.06589""")
stream_filter = StreamFilter(Gate=Toggle(True), Stream0=testdata_1, Stream1=testdata_2)
classification_001b = Script(Z=stream_filter)  # -> out, A; inputs Z: list of Double
# ---------- classification_001b: Python ----------
#! python3
#r: openpyxl, psycopg2, IPython

import rhinoscriptsyntax as rs
import scriptcontext as sc
import System
from System.Collections.Generic import List
import Rhino

import sys
import pandas as pd
import numpy as np
import scipy as sp
import IPython
import sklearn
from sklearn.model_selection import train_test_split
from sklearn.linear_model import LogisticRegression
from sklearn.datasets import load_breast_cancer
from keras.models import Sequential
from keras.layers import Dense
import tensorflow as tf
from Grasshopper import DataTree
from Grasshopper.Kernel.Data import GH_Path

# Load the breast cancer dataset
data = load_breast_cancer()
X = data['data']
y = data['target']

# Split the dataset into training and testing sets
X_train, X_test, y_train, y_test = train_test_split(X, y, test_size=0.3, random_state=42)

# Initialize and train a logistic regression model
model = LogisticRegression(max_iter=10000)
model.fit(X_train, y_train)

# Function to predict using model based on input features
def predict_cancer(features):
    # Convert features from list to numpy array and reshape for a single sample
    features_array = np.array(features).reshape(1, -1)
    prediction = model.predict(features_array)
    return prediction[0]

# Create a DataTree for output
prediction_output = DataTree[object]()

# Function to be called with 'Z' input from Grasshopper
def update_prediction(features):
    if len(features) == 30:
        result = predict_cancer(features)
        prediction_output.ClearData()
        prediction_output.Add(result, GH_Path(0))
    else:
        print("Error: Exactly 30 features are required.")

# Outputs
A = prediction_output

# Z is a list of 30 floats. Connect this variable to a panel in Grasshopper that provides 30 numeric inputs.
#Z = [1.0] * 30  # Example placeholder, replace this with the actual connection from Grasshopper

# The update_prediction function should be triggered whenever Z is updated in Grasshopper.
update_prediction(Z)  # Example call, replace this with the actual trigger from Grasshopper
# ---------- end classification_001b ----------
panel_2 = Panel(classification_001b.A)

# ----
# Course 1 / Week 1 / Lesson 2 part 3
classification_001 = Script()  # -> out, A, B, C, D
# ---------- classification_001: Python ----------
#! python3
#r: openpyxl, psycopg2, IPython

import rhinoscriptsyntax as rs
import scriptcontext as sc
import System
from System.Collections.Generic import List
import Rhino

import sys
import pandas as pd
import numpy as np
import scipy as sp
import IPython
import sklearn
from sklearn.model_selection import train_test_split
from sklearn.linear_model import LogisticRegression
from sklearn.datasets import load_breast_cancer
from keras.models import Sequential
from keras.layers import Dense
import tensorflow as tf
from Grasshopper import DataTree
from Grasshopper.Kernel.Data import GH_Path

# Function to add items to a DataTree
def add_to_datatree(path, items, tree):
    for item in items:
        tree.Add(item, GH_Path(path))

# Load the breast cancer dataset
data = load_breast_cancer()
X = data['data']
y = data['target']
feature_names = data['feature_names']
target_names = data['target_names']

# Split the dataset into training and testing sets
X_train, X_test, y_train, y_test = train_test_split(X, y, test_size=0.3, random_state=42)

# Initialize and train a logistic regression model
model = LogisticRegression(max_iter=10000)
model.fit(X_train, y_train)

# Predict on the test set
predictions = model.predict(X_test)
prediction_probabilities = model.predict_proba(X_test)[:, 1]

# Create DataTrees for output
x_test_tree = DataTree[object]()
predictions_tree = DataTree[object]()
probabilities_tree = DataTree[object]()
model_accuracy = DataTree[object]()

# Add test data and predictions to DataTrees
add_to_datatree(0, X_test.tolist(), x_test_tree)
add_to_datatree(0, predictions, predictions_tree)
add_to_datatree(0, prediction_probabilities, probabilities_tree)
model_accuracy.Add(model.score(X_test, y_test), GH_Path(0))

# Outputs
A = x_test_tree
B = predictions_tree
C = probabilities_tree
D = model_accuracy
# ---------- end classification_001 ----------
# Machine Learning
# Interpreting  Machine Learning
# Specialization YouTube Course
# by Andrew Ng
# into Grasshopper Canvas and
# Rhino8 Environment at
# Wickerson Studios
# Gh_files uploads at
# www.wickersonstudios.com
panel_3 = Panel(classification_001.A)
panel_4 = Panel(classification_001.B)
panel_5 = Panel(classification_001.C)
panel_6 = Panel(classification_001.D)
