# Grasshopper definition 3.0_ML_Ng_CourseWeekLesson_112d.gh (Grasshopper 1.0.8)
# plug-ins: RhinoCodePluginGH

# ----
# Created at
# Wickerson Studios
# copyright 2024
# download all materials at
# www.wickersonstudios.com
# import sys
# print(sys.path)
# 
# You will find where python is installed.
# They actually get a separated python 3.9 for
# Rhino8 for you (from what I see).
# 
# Then go to the directory of that python3.9,
# inside folder \Scripts you will find pip.
# Then go to cmd, cd to the directory of the
# \Scripts folder (The Rhino8 one).
# Then you can pip install whatever you want.
# I got matplotlib successfully installed in my case.
# 
# EXAMPLE ADDITIONAL REQUIREMENTS:
# 
# #! python3
# #r: openpyxl, psycopg2
# MACHINE LEARNING IN GRASSHOPPER
# PANDAS
# 
# NUMPY
# 
# SCIPY
# 
# IPYTHON
# 
# SCIKIT-LEARN
# 
# KERAS
# 
# TENSORFLOW
# from DATAFRAMES to DATATREES
www_wickersonstudios_com = Script()  # -> out, A
# ---------- www_wickersonstudios_com: Python ----------
#! python3
#r: openpyxl, psycopg2, IPython

import rhinoscriptsyntax as rs
import scriptcontext as sc
import System
import System.Collections.Generic
import Rhino

import sys
import pandas as pd
import matplotlib
from matplotlib import pyplot as plt
import numpy as np
import scipy as sp
import IPython
import sklearn
import tensorflow as tf
import keras
from Grasshopper import DataTree
from Grasshopper.Kernel.Data import GH_Path

# Function to add text to a DataTree
def add_to_datatree(path, text, tree):
    tree.Add(text, path)

# Create a DataTree to store version information
version_info = DataTree[object]()

# Adding version information to the DataTree
add_to_datatree(GH_Path(0), "Python version: {}".format(sys.version), version_info)
add_to_datatree(GH_Path(1), "pandas version: {}".format(pd.__version__), version_info)
add_to_datatree(GH_Path(2), "matplotlib version: {}".format(matplotlib.__version__), version_info)
add_to_datatree(GH_Path(3), "NumPy version: {}".format(np.__version__), version_info)
add_to_datatree(GH_Path(4), "SciPy version: {}".format(sp.__version__), version_info)
add_to_datatree(GH_Path(5), "IPython version: {}".format(IPython.__version__), version_info)
add_to_datatree(GH_Path(6), "scikit-learn version: {}".format(sklearn.__version__), version_info)
add_to_datatree(GH_Path(7), "Keras version: {}".format(keras.__version__), version_info)
add_to_datatree(GH_Path(8), "TensorFlow version: {}".format(tf.__version__), version_info)

# Output the DataTree
A = version_info
# ---------- end www_wickersonstudios_com ----------
panel = Panel(www_wickersonstudios_com.A)

# ----
# Machine Learning
# Interpreting  Machine Learning
# Specialization YouTube Course
# by Andrew Ng
# into Grasshopper Canvas and
# Rhino8 Environment at
# Wickerson Studios
# Gh_files uploads at
# www.wickersonstudios.com
# Course 1 / Week 1 / Lesson 2 part 4
unsupervised_001 = Script()  # -> out, A
# ---------- unsupervised_001: Python ----------
import nltk
from newspaper import Article, Config
from sklearn.feature_extraction.text import TfidfVectorizer
from sklearn.cluster import KMeans
from nltk.corpus import stopwords
from nltk.tokenize import word_tokenize
from nltk.stem import WordNetLemmatizer
import string

# Download NLTK resources
nltk.download('punkt')
nltk.download('stopwords')
nltk.download('wordnet')

# Function to fetch articles from multiple news sources
def fetch_articles(query, num_articles=10):
    articles = []
    google_news_url = f"https://news.google.com/search?q={query}&hl=en-US&gl=US&ceid=US:en"
    cnn_url = f"https://www.cnn.com/search/?q={query}"
    bbc_url = f"https://www.bbc.co.uk/search?q={query}"
    
    # Configure newspaper to avoid paywalls and to extract full text
    config = Config()
    config.browser_user_agent = 'Mozilla/5.0 (Windows NT 10.0; Win64; x64) AppleWebKit/537.36 (KHTML, like Gecko) Chrome/58.0.3029.110 Safari/537.3'

    # Fetch articles from multiple news sources
    for url in [google_news_url, cnn_url, bbc_url]:
        news_source = Article(url, config=config)
        news_source.download()
        news_source.parse()
        articles.append(news_source.text)
        if len(articles) >= num_articles:
            break
    
    return articles[:num_articles]

# Function to preprocess text
def preprocess_text(text):
    # Tokenize text
    tokens = word_tokenize(text)
    
    # Remove punctuation and lowercase tokens
    tokens = [token.lower() for token in tokens if token not in string.punctuation]
    
    # Remove stopwords
    stop_words = set(stopwords.words('english'))
    tokens = [token for token in tokens if token not in stop_words]
    
    # Lemmatize tokens
    lemmatizer = WordNetLemmatizer()
    tokens = [lemmatizer.lemmatize(token) for token in tokens]
    
    # Remove tokens with length less than 2
    tokens = [token for token in tokens if len(token) > 1]
    
    return " ".join(tokens)

# Function to perform clustering on preprocessed articles
def cluster_articles(articles, num_clusters=3):
    # Preprocess articles
    preprocessed_articles = [preprocess_text(article) for article in articles]
    
    # Filter out empty preprocessed articles
    preprocessed_articles = [article for article in preprocessed_articles if article]

    # Check if any preprocessed articles exist
    if not preprocessed_articles:
        print("No valid articles found after preprocessing.")
        return ""

    # Vectorize preprocessed articles
    vectorizer = TfidfVectorizer(stop_words='english', min_df=1)
    X = vectorizer.fit_transform(preprocessed_articles)

    # Perform clustering
    kmeans = KMeans(n_clusters=num_clusters, random_state=42)
    kmeans.fit(X)
    labels = kmeans.labels_
    
    # Assign articles to clusters
    clusters = {}
    for i in range(num_clusters):
        cluster_articles = [preprocessed_articles[j] for j in range(len(preprocessed_articles)) if labels[j] == i]
        clusters[f"Cluster {i+1}"] = cluster_articles
    
    # Convert clusters to a text string
    text_clusters = []
    for cluster, articles in clusters.items():
        text_cluster = f"Cluster {cluster}:\n"
        text_cluster += "\n".join(articles)
        text_clusters.append(text_cluster)
    
    return "\n\n".join(text_clusters)

# Main function to fetch and cluster news articles
def main():
    # Fetch articles
    query = "Covid-19"
    articles = fetch_articles(query, num_articles=20)

    # Perform clustering
    num_clusters = 3
    output_A = cluster_articles(articles, num_clusters)

    return output_A

if __name__ == "__main__":
    A = main()
    print(A)
# ---------- end unsupervised_001 ----------
panel_2 = Panel(unsupervised_001.out)
# data visualization
panel_3 = Panel(unsupervised_001.A)
