# Grasshopper definition 3.0_ML_Ng_CourseWeekLesson_112e.gh (Grasshopper 1.0.8)
# plug-ins: RhinoCodePluginGH

# ----
# Created at
# Wickerson Studios
# copyright 2024
# download all materials at
# www.wickersonstudios.com
# import sys
# print(sys.path)
# 
# You will find where python is installed.
# They actually get a separated python 3.9 for
# Rhino8 for you (from what I see).
# 
# Then go to the directory of that python3.9,
# inside folder \Scripts you will find pip.
# Then go to cmd, cd to the directory of the
# \Scripts folder (The Rhino8 one).
# Then you can pip install whatever you want.
# I got matplotlib successfully installed in my case.
# 
# EXAMPLE ADDITIONAL REQUIREMENTS:
# 
# #! python3
# #r: openpyxl, psycopg2
# MACHINE LEARNING IN GRASSHOPPER
# PANDAS
# 
# NUMPY
# 
# SCIPY
# 
# IPYTHON
# 
# SCIKIT-LEARN
# 
# KERAS
# 
# TENSORFLOW
# from DATAFRAMES to DATATREES
www_wickersonstudios_com = Script()  # -> out, A
# ---------- www_wickersonstudios_com: Python ----------
#! python3
#r: openpyxl, psycopg2, IPython

import rhinoscriptsyntax as rs
import scriptcontext as sc
import System
import System.Collections.Generic
import Rhino

import sys
import pandas as pd
from matplotlib import pyplot as plt
import numpy as np
import scipy as sp
import IPython
import sklearn
import tensorflow as tf
import keras
from Grasshopper import DataTree
from Grasshopper.Kernel.Data import GH_Path

# Function to add text to a DataTree
def add_to_datatree(path, text, tree):
    tree.Add(text, path)

# Create a DataTree to store version information
version_info = DataTree[object]()

# Adding version information to the DataTree
add_to_datatree(GH_Path(0), "Python version: {}".format(sys.version), version_info)
add_to_datatree(GH_Path(1), "pandas version: {}".format(pd.__version__), version_info)
#add_to_datatree(GH_Path(2), "matplotlib version: {}".format(matplotlib.__version__), version_info)
add_to_datatree(GH_Path(3), "NumPy version: {}".format(np.__version__), version_info)
add_to_datatree(GH_Path(4), "SciPy version: {}".format(sp.__version__), version_info)
add_to_datatree(GH_Path(5), "IPython version: {}".format(IPython.__version__), version_info)
add_to_datatree(GH_Path(6), "scikit-learn version: {}".format(sklearn.__version__), version_info)
add_to_datatree(GH_Path(7), "Keras version: {}".format(keras.__version__), version_info)
add_to_datatree(GH_Path(8), "TensorFlow version: {}".format(tf.__version__), version_info)

# Output the DataTree
A = version_info
# ---------- end www_wickersonstudios_com ----------
panel = Panel(www_wickersonstudios_com.A)

# ----
# Machine Learning
# Interpreting  Machine Learning
# Specialization YouTube Course
# by Andrew Ng
# into Grasshopper Canvas and
# Rhino8 Environment at
# Wickerson Studios
# Gh_files uploads at
# www.wickersonstudios.com
# Course 1 / Week 1 / Lesson 2 part 4
unsupervised_002 = Script()  # -> out, A
# ---------- unsupervised_002: Python ----------
import numpy as np
import pandas as pd
from sklearn.cluster import KMeans
from sklearn.preprocessing import StandardScaler
import requests
import io
import os

# Set the locale to a known value
os.environ['LC_ALL'] = 'C.UTF-8'
os.environ['LANG'] = 'C.UTF-8'

# Function to fetch microarray data from an online resource
def fetch_microarray_data(url):
    try:
        response = requests.get(url)
        if response.status_code == 200:
            data = pd.read_csv(io.StringIO(response.content.decode('utf-8')))
            return data
        else:
            print(f"Failed to fetch data. Status code: {response.status_code}")
            return None
    except Exception as e:
        print(f"Error fetching data: {e}")
        return None

# URL to the microarray dataset
url = "https://example.com/microarray_data.csv"  # Replace with the actual URL

# Fetch microarray data
data = fetch_microarray_data(url)
if data is None:
    print("Data fetching failed. Exiting script.")
elif data.empty or not data.select_dtypes(include=[np.number]).columns.tolist():
    print("No numeric data available for processing. Exiting script.")
else:
    # Preprocess the data
    scaler = StandardScaler()
    numeric_columns = data.select_dtypes(include=[np.number]).columns
    if numeric_columns.empty:
        print("No numeric columns to scale. Exiting script.")
    else:
        data[numeric_columns] = scaler.fit_transform(data[numeric_columns])

        # Perform clustering
        num_clusters = 3  # Adjust the number of clusters as needed
        kmeans = KMeans(n_clusters=num_clusters, random_state=42)
        kmeans.fit(data[numeric_columns])

        # Get the cluster labels
        data['Cluster'] = kmeans.labels_

        # Output the results
        A = data  # 'A' now contains the dataset with cluster labels
        print(A)
# ---------- end unsupervised_002 ----------
panel_2 = Panel(unsupervised_002.out)
# data visualization
panel_3 = Panel(unsupervised_002.A)
