# Grasshopper definition 3.0_ML_Ng_CourseWeekLesson_112g.gh (Grasshopper 1.0.8)
# plug-ins: RhinoCodePluginGH

# ----
# Created at
# Wickerson Studios
# copyright 2024
# download all materials at
# www.wickersonstudios.com
# import sys
# print(sys.path)
# 
# You will find where python is installed.
# They actually get a separated python 3.9 for
# Rhino8 for you (from what I see).
# 
# Then go to the directory of that python3.9,
# inside folder \Scripts you will find pip.
# Then go to cmd, cd to the directory of the
# \Scripts folder (The Rhino8 one).
# Then you can pip install whatever you want.
# I got matplotlib successfully installed in my case.
# 
# EXAMPLE ADDITIONAL REQUIREMENTS:
# 
# #! python3
# #r: openpyxl, psycopg2
# MACHINE LEARNING IN GRASSHOPPER
# PANDAS
# 
# NUMPY
# 
# SCIPY
# 
# IPYTHON
# 
# SCIKIT-LEARN
# 
# KERAS
# 
# TENSORFLOW
# from DATAFRAMES to DATATREES
www_wickersonstudios_com = Script()  # -> out, A
# ---------- www_wickersonstudios_com: Python ----------
#! python3
#r: openpyxl, psycopg2, IPython

import rhinoscriptsyntax as rs
import scriptcontext as sc
import System
import System.Collections.Generic
import Rhino

import sys
import pandas as pd
import matplotlib 
from matplotlib import pyplot as plt
import numpy as np
import scipy as sp
import IPython
import sklearn
import tensorflow as tf
import keras
from Grasshopper import DataTree
from Grasshopper.Kernel.Data import GH_Path

# Function to add text to a DataTree
def add_to_datatree(path, text, tree):
    tree.Add(text, path)

# Create a DataTree to store version information
version_info = DataTree[object]()

# Adding version information to the DataTree
add_to_datatree(GH_Path(0), "Python version: {}".format(sys.version), version_info)
add_to_datatree(GH_Path(1), "pandas version: {}".format(pd.__version__), version_info)
add_to_datatree(GH_Path(2), "matplotlib version: {}".format(matplotlib.__version__), version_info)
add_to_datatree(GH_Path(3), "NumPy version: {}".format(np.__version__), version_info)
add_to_datatree(GH_Path(4), "SciPy version: {}".format(sp.__version__), version_info)
add_to_datatree(GH_Path(5), "IPython version: {}".format(IPython.__version__), version_info)
add_to_datatree(GH_Path(6), "scikit-learn version: {}".format(sklearn.__version__), version_info)
add_to_datatree(GH_Path(7), "Keras version: {}".format(keras.__version__), version_info)
add_to_datatree(GH_Path(8), "TensorFlow version: {}".format(tf.__version__), version_info)

# Output the DataTree
A = version_info
# ---------- end www_wickersonstudios_com ----------
panel = Panel(www_wickersonstudios_com.A)

# ----
# Course 1 / Week 1 / Lesson 2 part 6
# data visualization
unsupervised_007 = Script()  # -> out, A
# ---------- unsupervised_007: Python ----------
import numpy as np
import pandas as pd
from sklearn.cluster import KMeans
from sklearn.preprocessing import StandardScaler
import matplotlib.pyplot as plt

# Generate synthetic customer data
np.random.seed(42)
data = {
    'Age': np.random.randint(18, 70, size=200),
    'Annual Income (k$)': np.random.randint(20, 150, size=200),
    'Spending Score (1-100)': np.random.randint(1, 100, size=200)
}
df = pd.DataFrame(data)

# Display first few rows of the data
print("Initial data:")
print(df.head())

# Preprocess the data
scaler = StandardScaler()
scaled_data = scaler.fit_transform(df)

# Perform clustering
num_clusters = 5  # You can adjust the number of clusters here
kmeans = KMeans(n_clusters=num_clusters, random_state=42)
kmeans.fit(scaled_data)

# Get the cluster labels
df['Cluster'] = kmeans.labels_

# Output the results
A = df  # 'A' now contains the dataset with cluster labels
print("\nData with clusters:")
print(A.head())

# Plot the results
plt.figure(figsize=(10, 6))
plt.scatter(df['Annual Income (k$)'], df['Spending Score (1-100)'], c=df['Cluster'], cmap='viridis')
plt.title('Customer Groups')
plt.xlabel('Annual Income (k$)')
plt.ylabel('Spending Score (1-100)')
plt.colorbar(label='Cluster')
plt.show()
# ---------- end unsupervised_007 ----------
# Machine Learning
# Interpreting  Machine Learning
# Specialization YouTube Course
# by Andrew Ng
# into Grasshopper Canvas and
# Rhino8 Environment at
# Wickerson Studios
# Gh_files uploads at
# www.wickersonstudios.com
panel_2 = Panel(unsupervised_007.A)
panel_3 = Panel(unsupervised_007.out)
