# Grasshopper definition 4.0_ML_Kaggle_001c.gh (Grasshopper 1.0.8)
# plug-ins: RhinoCodePluginGH

# ----
# Created at
# Wickerson Studios
# copyright 2024
# download all materials at
# www.wickersonstudios.com
# import sys
# print(sys.path)
# 
# You will find where python is installed.
# They actually get a separated python 3.9 for
# Rhino8 for you (from what I see).
# 
# Then go to the directory of that python3.9,
# inside folder \Scripts you will find pip.
# Then go to cmd, cd to the directory of the
# \Scripts folder (The Rhino8 one).
# Then you can pip install whatever you want.
# I got matplotlib successfully installed in my case.
# 
# EXAMPLE ADDITIONAL REQUIREMENTS:
# 
# #! python3
# #r: openpyxl, psycopg2
# MACHINE LEARNING IN GRASSHOPPER
# PANDAS
# 
# NUMPY
# 
# SCIPY
# 
# IPYTHON
# 
# SCIKIT-LEARN
# 
# KERAS
# 
# TENSORFLOW
# from DATAFRAMES to DATATREES
www_wickersonstudios_com = Script()  # -> out, A
# ---------- www_wickersonstudios_com: Python ----------
#! python3
#r: openpyxl, psycopg2, IPython

import rhinoscriptsyntax as rs
import scriptcontext as sc
import System
import System.Collections.Generic
import Rhino

import sys
import pandas as pd
from matplotlib import pyplot as plt
import numpy as np
import scipy as sp
import IPython
import sklearn
import tensorflow as tf
import keras
from Grasshopper import DataTree
from Grasshopper.Kernel.Data import GH_Path

# Function to add text to a DataTree
def add_to_datatree(path, text, tree):
    tree.Add(text, path)

# Create a DataTree to store version information
version_info = DataTree[object]()

# Adding version information to the DataTree
add_to_datatree(GH_Path(0), "Python version: {}".format(sys.version), version_info)
add_to_datatree(GH_Path(1), "pandas version: {}".format(pd.__version__), version_info)
#add_to_datatree(GH_Path(2), "matplotlib version: {}".format(matplotlib.__version__), version_info)
add_to_datatree(GH_Path(3), "NumPy version: {}".format(np.__version__), version_info)
add_to_datatree(GH_Path(4), "SciPy version: {}".format(sp.__version__), version_info)
add_to_datatree(GH_Path(5), "IPython version: {}".format(IPython.__version__), version_info)
add_to_datatree(GH_Path(6), "scikit-learn version: {}".format(sklearn.__version__), version_info)
add_to_datatree(GH_Path(7), "Keras version: {}".format(keras.__version__), version_info)
add_to_datatree(GH_Path(8), "TensorFlow version: {}".format(tf.__version__), version_info)

# Output the DataTree
A = version_info
# ---------- end www_wickersonstudios_com ----------
panel = Panel(www_wickersonstudios_com.A)

# ----
# data visualization
home_credit = Script()  # -> out, dataPath
# ---------- home_credit: Python ----------
#!/usr/bin/env python3
# -*- coding: utf-8 -*-

import openpyxl
import psycopg2
from IPython import get_ipython

import rhinoscriptsyntax as rs
import scriptcontext as sc
import System
from System.Collections.Generic import List
import Rhino

import pandas as pd
import numpy as np
import polars as pl
import lightgbm as lgb
from sklearn.metrics import roc_auc_score
from sklearn.model_selection import train_test_split
from Grasshopper import DataTree
from Grasshopper.Kernel.Data import GH_Path

dataPath = "/kaggle/input/home-credit-credit-risk-model-stability/"

def set_table_dtypes(df: pl.DataFrame) -> pl.DataFrame:
    # Implement here all desired dtypes for tables
    # The following is just an example
    for col in df.columns:
        # Last letter of column name will help you determine the type
        if col[-1] in ("P", "A"):
            df = df.with_columns(pl.col(col).cast(pl.Float64).alias(col))

    return df

def convert_strings(df: pd.DataFrame) -> pd.DataFrame:
    for col in df.columns:  
        if df[col].dtype.name in ['object', 'string']:
            df[col] = df[col].astype("string").astype('category')
            current_categories = df[col].cat.categories
            new_categories = current_categories.to_list() + ["Unknown"]
            new_dtype = pd.CategoricalDtype(categories=new_categories, ordered=True)
            df[col] = df[col].astype(new_dtype)
    return df

# Sample usage of the functions
# Assuming df is a polars DataFrame
df = pl.DataFrame({"A": [1, 2, 3], "B": [4, 5, 6], "C": [7, 8, 9]})
print("Original DataFrame:")
print(df)

# Applying set_table_dtypes function
df = set_table_dtypes(df)
print("\nDataFrame after setting table dtypes:")
print(df)

# Assuming df_pd is a pandas DataFrame
df_pd = pd.DataFrame({"A": ["foo", "bar", "foo"], "B": ["one", "two", "three"], "C": [1, 2, 3]})
print("\nOriginal Pandas DataFrame:")
print(df_pd)

# Applying convert_strings function
df_pd = convert_strings(df_pd)
print("\nPandas DataFrame after converting strings:")
print(df_pd)
# ---------- end home_credit ----------
# HOW TO WIN A
# Machine Learning
# KAGGLE COMPETITION
# into Grasshopper Canvas and
# Rhino8 Environment at
# Wickerson Studios
# Gh_files uploads at
# www.wickersonstudios.com
# Kaggle Competition
# Home Credit - Credit Risk Model Stability
home_credit_2 = Script()  # -> out, dataPath
# ---------- home_credit_2: Python ----------
#! python3
#r: openpyxl, psycopg2, IPython

import rhinoscriptsyntax as rs
import scriptcontext as sc
import System
from System.Collections.Generic import List
import Rhino

import pandas as pd
import numpy as np
import polars as pl
import lightgbm as lgb
from sklearn.metrics import roc_auc_score
from sklearn.model_selection import train_test_split
from Grasshopper import DataTree
from Grasshopper.Kernel.Data import GH_Path

dataPath = "/kaggle/input/home-credit-credit-risk-model-stability/"
# ---------- end home_credit_2 ----------
panel_2 = Panel(home_credit.dataPath)
panel_3 = Panel(home_credit_2.dataPath)
panel_4 = Panel(home_credit.out)
