# Grasshopper definition 5.0_ML_FlaskApp_001.gh (Grasshopper 1.0.8)
# plug-ins: RhinoCodePluginGH

# ----
# import sys
# print(sys.path)
# 
# You will find where python is installed.
# They actually get a separated python 3.9 for
# Rhino8 for you (from what I see).
# 
# Then go to the directory of that python3.9,
# inside folder \Scripts you will find pip.
# Then go to cmd, cd to the directory of the
# \Scripts folder (The Rhino8 one).
# Then you can pip install whatever you want.
# I got matplotlib successfully installed in my case.
# 
# EXAMPLE ADDITIONAL REQUIREMENTS:
# 
# #! python3
# #r: openpyxl, psycopg2
# MACHINE LEARNING IN GRASSHOPPER
# PANDAS
# 
# NUMPY
# 
# SCIPY
# 
# IPYTHON
# 
# SCIKIT-LEARN
# 
# KERAS
# 
# TENSORFLOW
# from DATAFRAMES to DATATREES
www_wickersonstudios_com = Script()  # -> out, A; disabled
# ---------- www_wickersonstudios_com: Python ----------
#! python3
#r: openpyxl, psycopg2, IPython

import rhinoscriptsyntax as rs
import scriptcontext as sc
import System
import System.Collections.Generic
import Rhino

import sys
import pandas as pd
import matplotlib 
from matplotlib import pyplot as plt
import numpy as np
import scipy as sp
import IPython
import sklearn
import tensorflow as tf
import keras
from Grasshopper import DataTree
from Grasshopper.Kernel.Data import GH_Path

# Function to add text to a DataTree
def add_to_datatree(path, text, tree):
    tree.Add(text, path)

# Create a DataTree to store version information
version_info = DataTree[object]()

# Adding version information to the DataTree
add_to_datatree(GH_Path(0), "Python version: {}".format(sys.version), version_info)
add_to_datatree(GH_Path(1), "pandas version: {}".format(pd.__version__), version_info)
add_to_datatree(GH_Path(2), "matplotlib version: {}".format(matplotlib.__version__), version_info)
add_to_datatree(GH_Path(3), "NumPy version: {}".format(np.__version__), version_info)
add_to_datatree(GH_Path(4), "SciPy version: {}".format(sp.__version__), version_info)
add_to_datatree(GH_Path(5), "IPython version: {}".format(IPython.__version__), version_info)
add_to_datatree(GH_Path(6), "scikit-learn version: {}".format(sklearn.__version__), version_info)
add_to_datatree(GH_Path(7), "Keras version: {}".format(keras.__version__), version_info)
add_to_datatree(GH_Path(8), "TensorFlow version: {}".format(tf.__version__), version_info)

# Output the DataTree
A = version_info
# ---------- end www_wickersonstudios_com ----------
# data visualization
panel = Panel(www_wickersonstudios_com.A)

# ----
# Created at
# Wickerson Studios
# copyright 2024
# download all materials at
# www.wickersonstudios.com
# Flask App
# into Grasshopper Canvas and
# Rhino8 Environment at
# Wickerson Studios
# Gh_files uploads at
# www.wickersonstudios.com
# 
# FLASK APP 101
boolean_toggle = BooleanToggle(True)
webapp_001 = Script(toggle=boolean_toggle)  # -> out, A; inputs toggle: Boolean
# ---------- webapp_001: Python ----------
import subprocess

def call_flask_api():
    # Path to the Python executable and client script, using raw strings
    python_exe = r"C:\Path\To\Python\python.exe"  # Update this path
    client_script = r"C:\Path\To\client.py"  # Update this path

    # Call the client script
    subprocess.Popen([python_exe, client_script])

toggle = x  # Replace `x` with the actual boolean toggle input from Grasshopper

if toggle:
    call_flask_api()
# ---------- end webapp_001 ----------
panel_2 = Panel(webapp_001.out)
panel_3 = Panel(webapp_001.A)
