# Grasshopper definition LOGO_ss.gh (Grasshopper 1.0.8)
# plug-ins: RhinoCodePluginGH

# ----
# MACHINE LEARNING IN GRASSHOPPER
# PANDAS
# 
# NUMPY
# 
# SCIPY
# 
# IPYTHON
# 
# SCIKIT-LEARN
# 
# KERAS
# 
# TENSORFLOW
# from DATAFRAMES to DATATREES
www_wickersonstudios_com = Script()  # -> out, A
# ---------- www_wickersonstudios_com: Python ----------
#! python 3

import rhinoscriptsyntax as rs
import scriptcontext as sc
import System
import System.Collections.Generic
import Rhino

import sys
import matplotlib
from matplotlib import pyplot as plt
import pandas as pd
import numpy as np
import scipy as sp
import IPython
import sklearn
import tensorflow as tf
import keras
from Grasshopper import DataTree
from Grasshopper.Kernel.Data import GH_Path

# Function to add text to a DataTree
def add_to_datatree(path, text, tree):
    tree.Add(text, path)

# Create a DataTree to store version information
version_info = DataTree[object]()

# Adding version information to the DataTree
add_to_datatree(GH_Path(0), "Python version: {}".format(sys.version), version_info)
add_to_datatree(GH_Path(1), "pandas version: {}".format(pd.__version__), version_info)
add_to_datatree(GH_Path(2), "matplotlib version: {}".format(matplotlib.__version__), version_info)
add_to_datatree(GH_Path(3), "NumPy version: {}".format(np.__version__), version_info)
add_to_datatree(GH_Path(4), "SciPy version: {}".format(sp.__version__), version_info)
add_to_datatree(GH_Path(5), "IPython version: {}".format(IPython.__version__), version_info)
add_to_datatree(GH_Path(6), "scikit-learn version: {}".format(sklearn.__version__), version_info)
add_to_datatree(GH_Path(7), "Keras version: {}".format(keras.__version__), version_info)
add_to_datatree(GH_Path(8), "TensorFlow version: {}".format(tf.__version__), version_info)

# Output the DataTree
A = version_info
# ---------- end www_wickersonstudios_com ----------
panel = Panel(www_wickersonstudios_com.A)
