# Grasshopper definition ML_Definition_1.1.gh (Grasshopper 1.0.8)
# plug-ins: RhinoCodePluginGH

# Created at
# Wickerson Studios
# copyright 2024
# download all materials at
# www.wickersonstudios.com
# 1.0 Basic notions and Version Space
# 1.1_ML_Definition
# from
# gpt Image Prompt
populate_2d = Populate2D(
    Region={Plane=PlaneXY(0, 0, 0), Size=Domain2(u=0..20, v=0..10)},
    Count=Slider(12, range=0..100),
    Seed=Slider(37, range=0..100))
_1_1_ml_definition = Script(points=populate_2d)  # -> out, A, B, MSE, Line; inputs points: list of Point3d
# ---------- _1_1_ml_definition: C# ----------
using System;
using System.Collections.Generic;
using System.Linq;
using System.Drawing;

using Rhino;
using Rhino.Geometry;

using Grasshopper;
using Grasshopper.Kernel;
using Grasshopper.Kernel.Types;

public class Script_Instance : GH_ScriptInstance
{
  private void RunScript(
	IList<Point3d> points,
	ref object A,
	ref object B,
	ref object MSE,
	ref object Line)
  {
    if (points == null || points.Count == 0)
    {
      A = 0;
      B = 0;
      MSE = 0;
      Line = null;
      return;
    }

    // Extract x and y values from the points
    var xVals = points.Select(pt => pt.X).ToArray();
    var yVals = points.Select(pt => pt.Y).ToArray();

    // Perform simple linear regression
    double a, b; // coefficients for y = ax + b
    SimpleLinearRegression(xVals, yVals, out a, out b);

    // Calculate mean squared error
    double mse = CalculateMSE(xVals, yVals, a, b);

    // Output results
    A = a;
    B = b;
    MSE = mse;

    // Create the regression line from the min and max x values
    double xMin = xVals.Min();
    double xMax = xVals.Max();
    Point3d start = new Point3d(xMin, a + b * xMin, 0);
    Point3d end = new Point3d(xMax, a + b * xMax, 0);
    Line = new Line(start, end);
  }

  // <Custom additional code> 

  void SimpleLinearRegression(double[] xVals, double[] yVals, out double a, out double b)
  {
    int n = xVals.Length;
    double meanX = xVals.Average();
    double meanY = yVals.Average();

    double sumX2 = xVals.Sum(x => x * x);
    double sumXY = xVals.Zip(yVals, (x, y) => x * y).Sum();

    // Calculating coefficients
    b = (sumXY - n * meanX * meanY) / (sumX2 - n * meanX * meanX);
    a = meanY - b * meanX;
  }

  double CalculateMSE(double[] xVals, double[] yVals, double a, double b)
  {
    double mse = 0;
    for (int i = 0; i < xVals.Length; i++)
    {
      double predicted = a + b * xVals[i];
      mse += (yVals[i] - predicted) * (yVals[i] - predicted);
    }
    return mse / xVals.Length;
  }

  // <Custom additional code end>
}
# ---------- end _1_1_ml_definition ----------
line = Line(_1_1_ml_definition.Line)
panel = Panel([_1_1_ml_definition.A, _1_1_ml_definition.B, _1_1_ml_definition.MSE, line])
param_viewer = ParamViewer(_1_1_ml_definition.A)
panel_2 = Panel(_1_1_ml_definition.out)
